# Dynamo graph 02_ResizeofElements.dyn (Dynamo 2.6.1.8786)

reorderingLayoutGarage = Python()  # unwired: IN[0]
# ---------- reorderingLayoutGarage.python (95 lines) ----------
# Load the Python Standard and DesignScript Libraries
import sys,os
from os import path
dumps_dir = path.expandvars(r'%LOCALAPPDATA%\Programs\RA\BIMRA')
sys.path.append(dumps_dir)
from ModClass import *
from RAForms import *
from LayFit import *
import clr
clr.AddReference('ProtoGeometry')
from Autodesk.DesignScript.Geometry import *
	
MACROS= IN[0]
BCHANGED=[]
NEWMACROS=[]
for a in MACROS:
	if a.NAM=="GARAGE":
		CSYS=a.CSYS.Translate(Vector.ByCoordinates(2,2,0))
		WID=20
		LEN=20
		SOL=Cuboid.ByLengths(CSYS,WID,LEN,a.HEI)
		NM=NewMacrobyMacro(a,CSYS,WID,LEN,SOL)
		BCHANGED.append(NM)
		NEWMACROS.append(NM)

# Place your code below this line
#Secondary MOD
for a in MACROS:
	if not a.NAM=="GARAGE":
		XINT=getmodulegrids(a)[0]
		YINT=getmodulegrids(a)[1]
		YCHA=getmodulegrids(BCHANGED[0])[1]
		if a.SOL.DoesIntersect(BCHANGED[0].SOL) and a.MM.SC5==0:
			if YINT.DoesIntersect(BCHANGED[0].SOL):
				XEXT2=extendLine(XINT,50)
				YDIS2=round(YINT.Intersect(BCHANGED[0].SOL)[0].Length,0)

RED1=[]
for a in MACROS:
	if not a.NAM=="GARAGE":
		XINT=getmodulegrids(a)[0]			
		YINT=getmodulegrids(a)[1]
		XCHA=getmodulegrids(BCHANGED[0])[0]
		YCHA=getmodulegrids(BCHANGED[0])[1]
		XEXT=extendLine(XCHA,50)
		if a.SOL.DoesIntersect(BCHANGED[0].SOL) and a.MM.SC5==0:
			if XINT.DoesIntersect(BCHANGED[0].SOL):
				XDIS=round(XINT.Intersect(BCHANGED[0].SOL)[0].Length,0)
				YDIS=round(YCHA.Length-YINT.Length,0)
				CSYS=a.CSYS.Translate(Vector.ByCoordinates(XDIS/2,YDIS/2,0))
				WID=a.WID-XDIS
				LEN=a.LEN+YDIS
				SOL=Cuboid.ByLengths(CSYS,WID,LEN,a.HEI)
				NM=NewMacrobyMacro(a,CSYS,WID,LEN,SOL)	
				NEWMACROS.append(NM)				
				RED1.append(SOL)
			elif YINT.DoesIntersect(BCHANGED[0].SOL):
				YEXT=extendLine(XINT,50)
				YDIS=round(YINT.Intersect(BCHANGED[0].SOL)[0].Length,0)
				CSYS=a.CSYS.Translate(Vector.ByCoordinates(0,YDIS/2,0))
				WID=a.WID
				LEN=a.LEN-YDIS
				SOL=Cuboid.ByLengths(CSYS,WID,LEN,a.HEI)
				NM=NewMacrobyMacro(a,CSYS,WID,LEN,SOL)
				NEWMACROS.append(NM)				
				RED1.append(SOL)
			else:
				if a.SOL.DoesIntersect(XEXT2):
					CSYS=a.CSYS.Translate(Vector.ByCoordinates(0,YDIS2/2,0))
					WID=a.WID
					LEN=a.LEN-YDIS2
					SOL=Cuboid.ByLengths(CSYS,WID,LEN,a.HEI)
					NM=NewMacrobyMacro(a,CSYS,WID,LEN,SOL)	
					NEWMACROS.append(NM)				
					RED1.append(SOL)
		elif a.SOL.DoesIntersect(XEXT):
			YDIS=round(YCHA.Length-YINT.Length,0)
			CSYS=a.CSYS.Translate(Vector.ByCoordinates(0,YDIS/2,0))
			WID=a.WID
			LEN=a.LEN+YDIS
			SOL=Cuboid.ByLengths(CSYS,WID,LEN,a.HEI)
			NM=NewMacrobyMacro(a,CSYS,WID,LEN,SOL)	
			NEWMACROS.append(NM)				
			RED1.append(SOL)
		elif a.SOL.DoesIntersect(XEXT2):
			CSYS=a.CSYS.Translate(Vector.ByCoordinates(0,YDIS2/2,0))
			WID=a.WID
			LEN=a.LEN-YDIS2
			SOL=Cuboid.ByLengths(CSYS,WID,LEN,a.HEI)
			NM=NewMacrobyMacro(a,CSYS,WID,LEN,SOL)	
			NEWMACROS.append(NM)				
			RED1.append(SOL)
		else:
			NEWMACROS.append(a)			
OUT=NEWMACROS	 
# ----------------------------------------
unifing_macros = Python(IN[0]=reorderingLayoutGarage)
# ---------- unifing_macros.python (66 lines) ----------
# Load the Python Standard and DesignScript Libraries
import sys,os
from os import path
dumps_dir = path.expandvars(r'%LOCALAPPDATA%\Programs\RA\BIMRA')
sys.path.append(dumps_dir)
from ModClass import *
from RAForms import *
from LayFit import *
import clr
clr.AddReference('ProtoGeometry')
from Autodesk.DesignScript.Geometry import *

# The inputs to this node will be stored as a list in the IN variables.
MACROS=IN[0]
RELEASEMACROS=[]
CENT=[]
LIV=0
DIN=0
ENT=0
VOI=0
for a in MACROS:
	if not (a.NAM == "LIVING" or a.NAM== "DINNER" or a.NAM== "ENTRANCE" or a.NAM=="VOID"):
		RELEASEMACROS.append(a)
	else:
		if a.NAM=="LIVING":
			LIV=1
		elif a.NAM=="DINNER":
			DIN=1
		elif a.NAM=="ENTRANCE":
			ENT=1
		elif a.NAM=="VOID":
			VOI=1
	CENT.append(a.CEN)
if LIV==1:		
	LIVING=allmacrosnamed(MACROS,"LIVING")
	RELEASEMACROS.append(unifiedvalues(LIVING))
if DIN==1:
	DINNER=allmacrosnamed(MACROS,"DINNER")
	RELEASEMACROS.append(unifiedvalues(DINNER))
if ENT==1:
	ENTRANCE=allmacrosnamed(MACROS,"ENTRANCE")
	RELEASEMACROS.append(unifiedvalues(ENTRANCE))
if VOI==1:
	VOID=allmacrosnamed(MACROS,"VOID")
	RELEASEMACROS.append(unifiedvalues(VOID))

ALLGEOS=[]
ALLNAMES=[]
ALLORIGINS=[]
WS=[]
HS=[]
LS=[]

for a,b in zip(RELEASEMACROS,range(len(RELEASEMACROS))):
	a.IOF=b+1
	ALLGEOS.append(a.SOL)
	ALLNAMES.append(a.NAM)
	ALLORIGINS.append(a.ORI)
	WS.append(a.WID)
	LS.append(a.LEN)
	HS.append(a.HEI)
	
	
	
# Assign your output to the OUT variable.
OUT = RELEASEMACROS,ALLGEOS,ALLNAMES,ALLORIGINS,WS,LS,HS
# ----------------------------------------
categories = Categories("OST_SpecialityEquipment")
all_elements_of_category = ElementsOfCategory(Category=categories)
getLocation = Element.GetLocation(element=all_elements_of_category)
code_block = CodeBlock { "THeigth"; }
getParameterValueByName = Element.GetParameterValueByName(element=all_elements_of_category, parameterName=code_block)
code_block_2 = CodeBlock(a=getParameterValueByName) { a/2; }
byCoordinates = Vector.ByCoordinates(z=code_block_2)
translate = Geometry.Translate(geometry=getLocation, direction=byCoordinates)
code_block_3 = CodeBlock { "TLength"; }
getParameterValueByName_2 = Element.GetParameterValueByName(element=all_elements_of_category, parameterName=code_block_3)
code_block_4 = CodeBlock { "TWidth"; }
getParameterValueByName_3 = Element.GetParameterValueByName(element=all_elements_of_category, parameterName=code_block_4)
byLengths = Cuboid.ByLengths(origin=translate, width=getParameterValueByName_2, length=getParameterValueByName_3, height=getParameterValueByName)
python_script = Python(IN[0]=byLengths, IN[1]=translate)
# ---------- python_script.python (37 lines) ----------
# Load the Python Standard and DesignScript Libraries
import sys,os
from os import path
dumps_dir = path.expandvars(r'%LOCALAPPDATA%\Programs\RA\BIMRA')
sys.path.append(dumps_dir)
from ModClass import *
from RAForms import *
from LayFit import *
import clr
clr.AddReference('ProtoGeometry')
from Autodesk.DesignScript.Geometry import *

# The inputs to this node will be stored as a list in the IN variables.
solids = IN[0]
points = IN[1]
CUR=[]
for a,b in zip(points,solids):
	CUR.append(soltoCurves(b,a.Z))

VERS=[]
HORS=[]
for a in CUR:
	for b in range(2):
		if a[b].StartPoint.X==a[b].EndPoint.X:
			VERS.append(a[b])
		else:
			HORS.append(a[b])
			
VER=ModNorVec("X",VERS)
HOR=ModNorVec("Y",HORS)

VECTORS=[]
for a,b in zip(VER,HOR):
	VECTORS.append(Vector.ByCoordinates(a,b,0))

# Assign your output to the OUT variable.
OUT = VECTORS
# ----------------------------------------
move_elements = Python(IN[0]=all_elements_of_category, IN[1]=python_script)
# ---------- move_elements.python (47 lines) ----------
import clr
clr.AddReference('ProtoGeometry')
from Autodesk.DesignScript.Geometry import *
# Import ToDSType(bool) extension method
clr.AddReference("RevitNodes")
import Revit
clr.ImportExtensions(Revit.Elements)
# Import geometry conversion extension methods
clr.ImportExtensions(Revit.GeometryConversion)
# Import DocumentManager and TransactionManager
clr.AddReference("RevitServices")

import RevitServices
from RevitServices.Persistence import DocumentManager
from RevitServices.Transactions import TransactionManager
from System.Collections.Generic import *
# Import RevitAPI

clr.AddReference("RevitAPI")
import Autodesk
from Autodesk.Revit.DB import *

doc = DocumentManager.Instance.CurrentDBDocument
uiapp = DocumentManager.Instance.CurrentUIApplication
app = uiapp.Application

elt = []
for i in IN[0]:
	elt.append(UnwrapElement(i).Id)
VECS=IN[1]

# Start Transaction
TransactionManager.Instance.EnsureInTransaction(doc)

cantmove=[]
for a,b in zip(elt,VECS):
	try:
		VE=b.ToRevitType()
		ElementTransformUtils.MoveElement(doc,a,VE)
	except:
		cantmove.append(item)

# End Transaction
TransactionManager.Instance.TransactionTaskDone()
doc.Regenerate()

OUT=cantmove
# ----------------------------------------
code_block_5 = CodeBlock { "WWidth"; }
setParameterByName = Element.SetParameterByName(element=all_elements_of_category, parameterName=code_block_5, value=getParameterValueByName_3)
code_block_6 = CodeBlock { "LLength"; }
setParameterByName_2 = Element.SetParameterByName(element=all_elements_of_category, parameterName=code_block_6, value=getParameterValueByName_2)
code_block_7 = CodeBlock { "HHeigth"; }
setParameterByName_3 = Element.SetParameterByName(element=all_elements_of_category, parameterName=code_block_7, value=getParameterValueByName)
