# Dynamo graph 03_BlendComonSpaces.dyn (Dynamo 2.6.1.8786)

categories = Categories("OST_SpecialityEquipment")
all_elements_of_category = ElementsOfCategory(Category=categories)
code_block = CodeBlock { "Type"; }
getParameterValueByName = Element.GetParameterValueByName(element=all_elements_of_category, parameterName=code_block)
code_block_2 = CodeBlock { "Name"; }
getParameterValueByName_2 = Element.GetParameterValueByName(element=getParameterValueByName, parameterName=code_block_2)
uniqueItems = List.UniqueItems(list=getParameterValueByName_2)
allIndicesOf = List.AllIndicesOf(list=getParameterValueByName_2, item=uniqueItems)
code_block_3 = CodeBlock { "ROOMS"; }
indexOf = List.IndexOf(list=uniqueItems, element=code_block_3)
removeItemAtIndex = List.RemoveItemAtIndex(list=allIndicesOf, indices=indexOf)
removeItemAtIndex_2 = List.RemoveItemAtIndex(list=uniqueItems, indices=indexOf)
code_block_4 = CodeBlock { "TERRACE"; }
indexOf_2 = List.IndexOf(list=removeItemAtIndex_2, element=code_block_4)
removeItemAtIndex_3 = List.RemoveItemAtIndex(list=removeItemAtIndex, indices=indexOf_2)
to_move = List.FirstItem(list=removeItemAtIndex_3@L2)
getItemAtIndex = List.GetItemAtIndex(list=all_elements_of_category, index=to_move)
getLocation = Element.GetLocation(element=all_elements_of_category)
getItemAtIndex_2 = List.GetItemAtIndex(list=getLocation, index=to_move)
getItemAtIndex_3 = List.GetItemAtIndex(list=getLocation, index=removeItemAtIndex_3)
geometry = Element.Geometry(element=all_elements_of_category)
flatten = List.Flatten(list=geometry)
getItemAtIndex_4 = List.GetItemAtIndex(list=flatten, index=removeItemAtIndex_3)
getting_measurements_complete = Python(IN[0]=getItemAtIndex_4, IN[1]=getItemAtIndex_3)
# ---------- getting_measurements_complete.python (34 lines) ----------
# Load the Python Standard and DesignScript Libraries
import sys,os
from os import path
dumps_dir = path.expandvars(r'%LOCALAPPDATA%\Programs\RA\BIMRA')
sys.path.append(dumps_dir)
from ModClass import *
from RAForms import *
from LayFit import *
import clr
clr.AddReference('ProtoGeometry')
from Autodesk.DesignScript.Geometry import *

# The inputs to this node will be stored as a list in the IN variables.
groups = IN[0]
originpoints=IN[1]

W=[]
L=[]
for a,b in zip(groups,originpoints):
	WT=[]
	LT=[]
	for c,d in zip(a,b):
		CUR=soltoCurves(c,d.Z)
		if CUR[0].StartPoint.X==CUR[0].EndPoint.X:
			WT.append(round(CUR[0].Length,0))
			LT.append(round(CUR[1].Length,0))
		else:
			WT.append(round(CUR[1].Length,0))
			LT.append(round(CUR[0].Length,0))
	W.append(WT)
	L.append(LT)

# Assign your output to the OUT variable.
OUT = W,L
# ----------------------------------------
code_block_5 = CodeBlock(a=getting_measurements_complete) { a[1]; }
code_block_6 = CodeBlock(a=getting_measurements_complete) { a[0]; }
python_script = Python(IN[0]=getItemAtIndex_3, IN[1]=code_block_5, IN[2]=code_block_6)
# ---------- python_script.python (40 lines) ----------
# Load the Python Standard and DesignScript Libraries
import sys,os
from os import path
dumps_dir = path.expandvars(r'%LOCALAPPDATA%\Programs\RA\BIMRA')
sys.path.append(dumps_dir)
from ModClass import *
from RAForms import *
from LayFit import *
import clr
clr.AddReference('ProtoGeometry')
from Autodesk.DesignScript.Geometry import *

# The inputs to this node will be stored as a list in the IN variables.
POIS = IN[0]
W=IN[1]
L=IN[2]
SOL=[]
for a,b,c in zip(POIS,W,L):
	if len(a)==1:
		SOL.append(a[0])
	else:
		X=0
		Y=0
		Z=0
		TX=0
		TY=0
		for d,e,f in zip(a,b,c):	
			X+=d.X*e
			Y+=d.Y*f
			Z+=d.Z
			TX+=e
			TY+=f
		XR=X/TX
		YR=Y/TY
		ZR=Z/len(a)
		SOL.append(Point.ByCoordinates(XR,YR,ZR))
# Place your code below this line

# Assign your output to the OUT variable.
OUT = SOL
# ----------------------------------------
byTwoPoints = Vector.ByTwoPoints(start=getItemAtIndex_2, end=python_script)
getItemAtIndex_5 = List.GetItemAtIndex(list=allIndicesOf, index=indexOf)
getItemAtIndex_6 = List.GetItemAtIndex(list=removeItemAtIndex, index=indexOf_2)
join = List.Join(list0=to_move, list1=getItemAtIndex_5, list2=getItemAtIndex_6)
sort = List.Sort(list=join)
flatten_2 = List.Flatten(list=allIndicesOf)
sort_2 = List.Sort(list=flatten_2)
to_remove = Python(IN[0]=sort, IN[1]=sort_2)
# ---------- to_remove.python (17 lines) ----------
# Load the Python Standard and DesignScript Libraries
import sys
import clr
clr.AddReference('ProtoGeometry')
from Autodesk.DesignScript.Geometry import *

# The inputs to this node will be stored as a list in the IN variables.
lista=IN[0]
listb=IN[1]

# Place your code below this line
missing=[]
for a in listb:
	if a not in lista:
		missing.append(a)
# Assign your output to the OUT variable.
OUT = missing
# ----------------------------------------
getItemAtIndex_7 = List.GetItemAtIndex(list=all_elements_of_category, index=to_remove)
getting_measurements = Python(IN[0]=getItemAtIndex_4, IN[1]=python_script)
# ---------- getting_measurements.python (29 lines) ----------
# Load the Python Standard and DesignScript Libraries
import sys,os
from os import path
dumps_dir = path.expandvars(r'%LOCALAPPDATA%\Programs\RA\BIMRA')
sys.path.append(dumps_dir)
from ModClass import *
from RAForms import *
from LayFit import *
import clr
clr.AddReference('ProtoGeometry')
from Autodesk.DesignScript.Geometry import *

# The inputs to this node will be stored as a list in the IN variables.
groups = IN[0]
originpoints=IN[1]

W=[]
L=[]
for a,b in zip(groups,originpoints):
	CUR=solstoCurvesFS(a,b.Z)
	if CUR[0].StartPoint.X==CUR[0].EndPoint.X:
		W.append(round(CUR[0].Length,0))
		L.append(round(CUR[1].Length,0))
	else:
		W.append(round(CUR[1].Length,0))
		L.append(round(CUR[0].Length,0))

# Assign your output to the OUT variable.
OUT = W,L,CUR
# ----------------------------------------
code_block_7 = CodeBlock(a=getting_measurements) { a[0]; }
code_block_8 = CodeBlock(a=getting_measurements) { a[1]; }
code_block_9 = CodeBlock { "THeigth"; }
getParameterValueByName_3 = Element.GetParameterValueByName(element=all_elements_of_category, parameterName=code_block_9)
getItemAtIndex_8 = List.GetItemAtIndex(list=getParameterValueByName_3, index=removeItemAtIndex_3)
minimumItem = List.MinimumItem(list=getItemAtIndex_8)
unify_macros = Python(IN[0]=getItemAtIndex, IN[1]=byTwoPoints, IN[2]=getItemAtIndex_7, IN[3]=code_block_7, IN[4]=code_block_8, IN[5]=minimumItem)
# ---------- unify_macros.python (66 lines) ----------
import clr
clr.AddReference('ProtoGeometry')
from Autodesk.DesignScript.Geometry import *
# Import ToDSType(bool) extension method
clr.AddReference("RevitNodes")
import Revit
clr.ImportExtensions(Revit.Elements)
# Import geometry conversion extension methods
clr.ImportExtensions(Revit.GeometryConversion)
# Import DocumentManager and TransactionManager
clr.AddReference("RevitServices")

import RevitServices
from RevitServices.Persistence import DocumentManager
from RevitServices.Transactions import TransactionManager
from System.Collections.Generic import *
# Import RevitAPI

clr.AddReference("RevitAPI")
import Autodesk
from Autodesk.Revit.DB import *

doc = DocumentManager.Instance.CurrentDBDocument
uiapp = DocumentManager.Instance.CurrentUIApplication
app = uiapp.Application

elt = []
for i in IN[0]:
	elt.append(UnwrapElement(i).Id)
VECS=IN[1]

elt2 = []
for i in IN[2]:
	elt2.append(UnwrapElement(i).Id)
W=IN[3]
L=IN[4]
H=IN[5]

# Start Transaction
TransactionManager.Instance.EnsureInTransaction(doc)

cantmove=[]
for a,b,c,d,e in zip(elt,VECS,W,L,H):
	try:
		VE=b.ToRevitType()
		ElementTransformUtils.MoveElement(doc,a,VE)
		doc.GetElement(a).LookupParameter("WWidth").Set(c)
		doc.GetElement(a).LookupParameter("LLength").Set(d)
		doc.GetElement(a).LookupParameter("HHeigth").Set(e)

	except:
		cantmove.append(a)
		
cantdelete=[]
for a in elt2:
	try:
		doc.Delete(a)
	except:
		cantdelete.append(a)
	

# End Transaction
TransactionManager.Instance.TransactionTaskDone()
doc.Regenerate()

OUT=cantmove
# ----------------------------------------
