# Dynamo graph 05_Subdivision.dyn (Dynamo 2.6.1.8786)

select_space_to_divide = DSModelElementSelection()  # 1 picked in the model; graph input
code_block = CodeBlock { "Type"; }
getParameterValueByName = Element.GetParameterValueByName(element=select_space_to_divide, parameterName=code_block)
code_block_2 = CodeBlock { "Name"; }
getParameterValueByName_2 = Element.GetParameterValueByName(element=getParameterValueByName, parameterName=code_block_2)
getLocation = Element.GetLocation(element=select_space_to_divide)
code_block_3 = CodeBlock { "TWidth"; }
getParameterValueByName_3 = Element.GetParameterValueByName(element=select_space_to_divide, parameterName=code_block_3)
code_block_4 = CodeBlock { "TLength"; }
getParameterValueByName_4 = Element.GetParameterValueByName(element=select_space_to_divide, parameterName=code_block_4)
code_block_5 = CodeBlock { "THeigth"; }
getParameterValueByName_5 = Element.GetParameterValueByName(element=select_space_to_divide, parameterName=code_block_5)
family_types = FamilyTypes("CIRCULANT:CIRCULANT")
all_elements_of_family_type = ElementsOfFamilyType(Family_Type=family_types)
geometry = Element.Geometry(element=all_elements_of_family_type)
python_script = Python(IN[0]=getParameterValueByName_2, IN[1]=getLocation, IN[2]=getParameterValueByName_3, IN[3]=getParameterValueByName_4, IN[4]=getParameterValueByName_5, IN[5]=geometry)
# ---------- python_script.python (51 lines) ----------
# Load the Python Standard and DesignScript Libraries
import sys,os
from os import path
dumps_dir = path.expandvars(r'%LOCALAPPDATA%\Programs\RA\BIMRA')
sys.path.append(dumps_dir)
from ModClass import *
from RAForms import *
from LayFit import *
import clr
clr.AddReference('ProtoGeometry')
from Autodesk.DesignScript.Geometry import *

# The inputs to this node will be stored as a list in the IN variables.
Name=IN[0]
Point=IN[1]
Width=IN[2]
Length=IN[3] 
Heigth=IN[4] 
CIRCS=IN[5] 
SURFS=[] 
for a in CIRCS:
	SURFS.append(Surface.ByLoft([a[1],a[2]]))

MAC=selfmacro(Name,Point,Length,Width,Heigth,0) 
INTS=[]
for a in SURFS:
	if a.DoesIntersect(MAC.SOL): 
		INTS.append(a)	
RESULT=MACCONFIG(Name,MAC,INTS)     
MAC1=RESULT[0]
 
ALLGEOS=[] 
ALLNAMES=[]
ALLORIGINS=[] 
WS=[]
HS=[]
LS=[]
for a,b in zip(MAC1,range(len(MAC1))):
	a.IOF=b+1
	ALLGEOS.append(a.SOL)
	ALLNAMES.append(a.NAM)
	ALLORIGINS.append(a.ORI) 
	WS.append(a.WID)
	LS.append(a.LEN)
	HS.append(a.HEI)
	
	
# Assign your output to the OUT variable.
OUT = ALLGEOS,ALLGEOS,ALLNAMES,ALLORIGINS,WS,LS,HS,MAC1     

  
# ----------------------------------------
code_block_6 = CodeBlock(t7=python_script)
# ---------- code_block_6.designscript (17 lines) ----------
family1 = Family.ByName("MACROS");
a = t7;
a1 = a;
t1 = Get.ValueAtIndex(a1, 2);
familytype1 = FamilyType.ByFamilyAndName(family1, t1);
a2 = a;
t3 = Get.ValueAtIndex(a2, 3);
familyinstance1 = FamilyInstance.ByPoint(familytype1, t3);
a3 = a;
t4 = Get.ValueAtIndex(a3, 4);
element1 = Element.SetParameterByName(familyinstance1, "LLength", t4);
a4 = a;
t5 = Get.ValueAtIndex(a4, 5);
element2 = Element.SetParameterByName(familyinstance1, "WWidth", t5);
a5 = a;
t6 = Get.ValueAtIndex(a5, 6);
element3 = Element.SetParameterByName(familyinstance1, "HHeigth", t6);
# ----------------------------------------
deleteUnused = Python()  # unwired: IN[0]
# ---------- deleteUnused.python (43 lines) ----------
import clr
clr.AddReference('ProtoGeometry')
from Autodesk.DesignScript.Geometry import *
# Import ToDSType(bool) extension method
clr.AddReference("RevitNodes")
import Revit
clr.ImportExtensions(Revit.Elements)
# Import geometry conversion extension methods
clr.ImportExtensions(Revit.GeometryConversion)
# Import DocumentManager and TransactionManager
clr.AddReference("RevitServices")

import RevitServices
from RevitServices.Persistence import DocumentManager
from RevitServices.Transactions import TransactionManager
from System.Collections.Generic import *
# Import RevitAPI

clr.AddReference("RevitAPI")
import Autodesk
from Autodesk.Revit.DB import *

doc = DocumentManager.Instance.CurrentDBDocument
uiapp = DocumentManager.Instance.CurrentUIApplication
app = uiapp.Application

elt=UnwrapElement(IN[0]).Id

# Start Transaction
TransactionManager.Instance.EnsureInTransaction(doc)

cantdelete=[]
try:
	doc.Delete(elt)
except:
	cantdelete.append(a)
	

# End Transaction
TransactionManager.Instance.TransactionTaskDone()
doc.Regenerate()

OUT=cantdelete
# ----------------------------------------
family_types_2 = FamilyTypes("MACROS:MBATH")
all_elements_of_family_type_2 = ElementsOfFamilyType(Family_Type=family_types_2)
getLocation_2 = Element.GetLocation(element=all_elements_of_family_type_2)
code_block_7 = CodeBlock { "TLength"; }
getParameterValueByName_6 = Element.GetParameterValueByName(element=all_elements_of_family_type_2, parameterName=code_block_7)
code_block_8 = CodeBlock { "TWidth"; }
getParameterValueByName_7 = Element.GetParameterValueByName(element=all_elements_of_family_type_2, parameterName=code_block_8)
code_block_9 = CodeBlock { "THeigth"; }
getParameterValueByName_8 = Element.GetParameterValueByName(element=all_elements_of_family_type_2, parameterName=code_block_9)
code_block_10 = CodeBlock { "Type"; }
getParameterValueByName_9 = Element.GetParameterValueByName(element=all_elements_of_family_type_2, parameterName=code_block_10)
code_block_11 = CodeBlock { "Name"; }
getParameterValueByName_10 = Element.GetParameterValueByName(element=getParameterValueByName_9, parameterName=code_block_11)
