# Dynamo graph 08_Allocations.dyn (Dynamo 2.6.1.8786)

code_block = CodeBlock { "DW_SET"; }
byName = Family.ByName(name=code_block)
types = Family.Types(family=byName)
all_elements_of_family_type = ElementsOfFamilyType(Family_Type=types)
getLocation = Element.GetLocation(element=all_elements_of_family_type)
geometry = Element.Geometry(element=all_elements_of_family_type)
code_block_2 = CodeBlock { 1; }
flatten = List.Flatten(list=geometry@L3, amt=code_block_2)
categories = Categories("OST_Walls")
all_elements_of_category = ElementsOfCategory(Category=categories)
getLocation_2 = Element.GetLocation(element=all_elements_of_category)
selected = DSModelElementSelection()  # 1 picked in the model; graph input
code_block_3 = CodeBlock { "Type"; }
getParameterValueByName = Element.GetParameterValueByName(element=selected, parameterName=code_block_3)
code_block_4 = CodeBlock { "Name"; }
getParameterValueByName_2 = Element.GetParameterValueByName(element=getParameterValueByName, parameterName=code_block_4)
getLocation_3 = Element.GetLocation(element=selected)
code_block_5 = CodeBlock { "TWidth"; }
getParameterValueByName_3 = Element.GetParameterValueByName(element=selected, parameterName=code_block_5)
code_block_6 = CodeBlock { "TLength"; }
getParameterValueByName_4 = Element.GetParameterValueByName(element=selected, parameterName=code_block_6)
code_block_7 = CodeBlock { "THeigth"; }
getParameterValueByName_5 = Element.GetParameterValueByName(element=selected, parameterName=code_block_7)
python_script = Python(IN[0]=getParameterValueByName_2, IN[1]=getLocation_3, IN[2]=getParameterValueByName_3, IN[3]=getParameterValueByName_4, IN[4]=getParameterValueByName_5)
# ---------- python_script.python (23 lines) ----------
# Load the Python Standard and DesignScript Libraries
import sys,os
from os import path
dumps_dir = path.expandvars(r'%LOCALAPPDATA%\Programs\RA\BIMRA')
sys.path.append(dumps_dir)
from ModClass import *
from RAForms import *
from LayFit import *
import clr
clr.AddReference('ProtoGeometry')
from Autodesk.DesignScript.Geometry import *

# The inputs to this node will be stored as a list in the IN variables.
Name=IN[0]
Point=IN[1]
Width=IN[2]
Length=IN[3] 
Heigth=IN[4]

MACRO = selfmacro(Name,Point,Length,Width,Heigth,1)
	 
# Assign your output to the OUT variable.
OUT = MACRO
# ----------------------------------------
family_types = FamilyTypes("CIRCULANT:CIRCULANT")
all_elements_of_family_type_2 = ElementsOfFamilyType(Family_Type=family_types)
geometry_2 = Element.Geometry(element=all_elements_of_family_type_2)
firstItem = List.FirstItem(list=geometry_2@L2)
MODULES = Python(IN[0]=python_script, IN[1]=firstItem)
# ---------- MODULES.python (61 lines) ----------
# Load the Python Standard and DesignScript Libraries
import sys,os
from os import path
dumps_dir = path.expandvars(r'%LOCALAPPDATA%\Programs\RA\BIMRA')
sys.path.append(dumps_dir)
from ModClass import *
from RAForms import *
from LayFit import *
import clr
clr.AddReference('ProtoGeometry')
from Autodesk.DesignScript.Geometry import *
import System.Collections.Generic
from System.Collections.Generic import List
from System.Collections.Generic import Dictionary

MAC = IN[0]
CIRLINES=shortline(IN[1])
XVEC=Vector.ByCoordinates(1,0,0)
YVEC=Vector.ByCoordinates(0,1,0)
MICROS=[]
ORIS=[]
#CREATING THE MICROUNIVERSE
if not (MAC.NAM == "VOID" or MAC.NAM== "BALCONY" or MAC.NAM == "TERRACE") : 
	LXGRID=MACTOGRIDS(MAC)[0]
	LYGRID=MACTOGRIDS(MAC)[1]
	CREATEMICROS(LXGRID,LYGRID,MAC,XVEC,YVEC,MICROS)
	ORIS.append(MAC.ORI)
 		
#CREATING THE INDEXDATABASE
indices=[]
for a in MICROS:
	indices.append(str(a.MIOF)+"_"+str(a.IOF))

SELIND=[]
CIRC=[]

for a in MICROS:
	for b in CIRLINES:
		POI=b.Translate(Vector.ByCoordinates(0,0,-1))
		if Cylinder.ByPointsRadius(POI.StartPoint,POI.EndPoint,1).DoesIntersect(a.SOL):
			SELIND.append(str(a.MIOF)+"_"+str(a.IOF))	
			CIRC.append(a.SOL)	

SELIND=list(set(SELIND))
for a in SELIND:
	indices.remove(a)
	
REMANENT=[]	
for a in MICROS:
	if (str(a.MIOF)+"_"+str(a.IOF)) in indices:	
		REMANENT.append(a)

GEOMS=[]
INDICES=[]
for a in MICROS:
	if (str(a.MIOF)+"_"+str(a.IOF)) in indices:	
		GEOMS.append(a.SOL)
		INDICES.append(str(a.MIOF)+"_"+str(a.IOF))
		
# Assign your output to the OUT variable.
OUT = REMANENT,MAC.NAM,ORIS
# ----------------------------------------
MINIS = CodeBlock(a=MODULES) { a[0]; }
macro_config = CodeBlock(a=MODULES) { a[1]; }
ORIGIN = CodeBlock(a=MODULES) { a[2]; }
create_layouts_01 = Python(IN[0]=getLocation, IN[1]=flatten, IN[2]=getLocation_2, IN[3]=MINIS, IN[4]=macro_config, IN[5]=ORIGIN)
# ---------- create_layouts_01.python (80 lines) ----------
# Load the Python Standard and DesignScript Libraries
import sys,os
from os import path
dumps_dir = path.expandvars(r'%LOCALAPPDATA%\Programs\RA\BIMRA')
sys.path.append(dumps_dir)
from ModClass import *
from RAForms import *
from LayFit import *
import clr
import System.Collections.Generic
from System.Collections.Generic import List
from System.Collections.Generic import Dictionary
import math
clr.AddReference('ProtoGeometry')
from Autodesk.DesignScript.Geometry import *

# The inputs to this node will be stored as a list in the IN variables.
DWORI=IN[0]
DWSOL=IN[1]
WALLS = IN[2]
MINIS = IN[3]
NAMES = IN[4]
ORIS=IN[5][0]
MOD=2

SOLDS=[]
for a in MINIS:
	SOLDS.append(a.SOL)

SOLIDSS=Solid.ByUnion(SOLDS)

if ORIS.Z<5:
	P1=Plane.ByOriginNormal(Point.ByCoordinates(0,0,0),Vector.ByCoordinates(0,0,1))
	SUR=SOLIDSS.Intersect(P1)[0]
else:
	P2=Plane.ByOriginNormal(Point.ByCoordinates(0,0,12),Vector.ByCoordinates(0,0,1))
	SUR=SOLIDSS.Intersect(P2)[0]

    
CUR=SUR.Edges
CURS=[]
for a in CUR:
	CURS.append(TOL(a.CurveGeometry))

POL=PolyCurve.ByJoinedCurves(CURS)
SUR=Surface.ByPatch(POL) 

TORIDOORS=[]
TSOLDOORS=[]
for b,c in zip(DWORI[0],DWSOL[0]):
	if c.DoesIntersect(SUR):
		TORIDOORS.append(b)
		TSOLDOORS.append(c)

TORIWIN=[]
TSOLWIN=[]
for b,c in zip(DWORI[1],DWSOL[1]):
	if c.DoesIntersect(SUR):
		TORIWIN.append(b)
		TSOLWIN.append(c)

TDORWIN=[TORIDOORS,TSOLDOORS,TORIWIN,TSOLWIN]

CABSS=[]
REC=createmodulesfromsurf(SUR,MOD) 
CLRECS=flattenlst3(REC)
LV=LINESANDVECS(CURS,CLRECS)
LV2=SPV(CURS,LV[0],LV[1])
CABS=[]
M=0
for a,b in zip(LV2[0],LV2[1]):
	modulate(a,b,2,1,2,0,0.5,1,M,CABS)
	M=M+(len(a))
CABSS.append(CABS) 

RESULTS=LAYINGOUTD(CABSS[0],NAMES,TDORWIN) 
 
# Assign your output to the OUT variable.

OUT = CABSS,RESULTS
# ----------------------------------------
MODS = CodeBlock(a=create_layouts_01) { a[0]; }
python_script_2 = Python(IN[0]=MODS)
# ---------- python_script_2.python (20 lines) ----------
# Load the Python Standard and DesignScript Libraries
import sys
import clr
clr.AddReference('ProtoGeometry')
from Autodesk.DesignScript.Geometry import *

# The inputs to this node will be stored as a list in the IN variables.
fur = IN[0]
# Place your code below this line
val1=[]

for a in fur:
	TASK=[]
	for b in a:
		TASK.append(b.SOL)
		TASK.append(b.SCA)
		TASK.append(b.SCB)
	val1.append(TASK)
# Assign your output to the OUT variable.
OUT = val1
# ----------------------------------------
FURNITURE = CodeBlock(a=create_layouts_01) { a[1]; }
flatten_2 = List.Flatten(list=FURNITURE)
python_script_3 = Python(IN[0]=flatten_2, IN[1]=getLocation_2, IN[2]=all_elements_of_category)
# ---------- python_script_3.python (27 lines) ----------
# Load the Python Standard and DesignScript Libraries
import sys
import clr
clr.AddReference('ProtoGeometry')
from Autodesk.DesignScript.Geometry import *

# The inputs to this node will be stored as a list in the IN variables.
FURS=IN[0]
WALLLINE=IN[1]
WALL=IN[2]

WALLFUR=[]
LOC=[]
VEC=[]
FAM=[] 
NAM=[]
for a in FURS:
	for b,c in zip(WALLLINE,WALL):
		if b.DoesIntersect(Sphere.ByCenterPointRadius(a.ORI,1)):
			WALLFUR.append(c)
	LOC.append(a.ORI)
	VEC.append(a.VEC)
	FAM.append(a.FAMNAM) 
	NAM.append(a.TYPE)	

# Assign your output to the OUT variable.
OUT = WALLFUR,LOC,VEC,FAM,NAM
# ----------------------------------------
code_block_8 = CodeBlock(a=python_script_3) { a[3]; }
byName_2 = Family.ByName(name=code_block_8)
code_block_9 = CodeBlock(a=python_script_3) { a[4]; }
byFamilyAndName = FamilyType.ByFamilyAndName(family=byName_2, name=code_block_9)
code_block_10 = CodeBlock(a=python_script_3) { a[1]; }
code_block_11 = CodeBlock(a=python_script_3) { a[2]; }
code_block_12 = CodeBlock(a=python_script_3) { a[0]; }
code_block_13 = CodeBlock { "Type"; }
getParameterValueByName_6 = Element.GetParameterValueByName(element=code_block_12, parameterName=code_block_13)
code_block_14 = CodeBlock { "Width"; }
getParameterValueByName_7 = Element.GetParameterValueByName(element=getParameterValueByName_6, parameterName=code_block_14)
code_block_15 = CodeBlock(a=getParameterValueByName_7) { Math.Round(a,2)/2; }
translate = Geometry.Translate(geometry=code_block_10, direction=code_block_11, distance=code_block_15)
byPoint = FamilyInstance.ByPoint(familyType=byFamilyAndName, point=translate)
python_script_4 = Python(IN[0]=code_block_11)
# ---------- python_script_4.python (19 lines) ----------
import sys,os
from os import path
dumps_dir = path.expandvars(r'%LOCALAPPDATA%\Programs\RA\BIMRA')
sys.path.append(dumps_dir)
from ModClass import *
from RAForms import *
from LayFit import *
import clr
clr.AddReference('ProtoGeometry')
from Autodesk.DesignScript.Geometry import *

# The inputs to this node will be stored as a list in the IN variables.
VECL = IN[0]

VECS=[]
for a in VECL:
	VECS.append(getangleofvector(a))
# Assign your output to the OUT variable.
OUT = VECS
# ----------------------------------------
setRotation = FamilyInstance.SetRotation(familyInstance=byPoint, degree=python_script_4)
