# Dynamo graph 01_Zoning.dyn (Dynamo 2.6.1.8786)

# group: INPUT CURVES
select_model_elements = DSModelElementsSelection()  # 4 picked in the model; graph input

# group: INPUTS
name = Element.Name(element=select_model_elements)
justModelLines = Python(IN[0]=name, IN[1]=select_model_elements)
# ---------- justModelLines.python (21 lines) ----------
# Load the Python Standard and DesignScript Libraries
import sys
import clr
clr.AddReference('ProtoGeometry')
from Autodesk.DesignScript.Geometry import *

# The inputs to this node will be stored as a list in the IN variables.
LNAM = IN[0]
INDEXES=[]
ELEM=IN[1]
for a,b in zip(LNAM,range(len(LNAM))):
	if "Model Lines" in a:
		INDEXES.append(b)
RELEM=[]
for a in INDEXES:
	RELEM.append(ELEM[a])	

# Place your code below this line

# Assign your output to the OUT variable.
OUT = RELEM
# ----------------------------------------

# group: Line Managment
code_block = CodeBlock { "Line Style"; }
getParameterValueByName = Element.GetParameterValueByName(element=justModelLines, parameterName=code_block)
name_2 = Element.Name(element=getParameterValueByName)
code_block_2 = CodeBlock { ["Side Line","Flunkage Line","Front Line","Rear Line"]; }
indexOf = List.IndexOf(list=name_2, element=code_block_2)
getItemAtIndex = List.GetItemAtIndex(list=justModelLines, index=indexOf)
curves = Element.Curves(element=getItemAtIndex)
flatten = List.Flatten(list=curves)

file_path = Filename(".\setbacks.xlsx")
file_from_path = FileObject(path=file_path)
code_block_3 = CodeBlock { "Hoja1"; }
code_block_4 = CodeBlock { false; }
importExcel = Data.ImportExcel(file=file_from_path, sheetName=code_block_3, readAsStrings=code_block_4, showExcel=code_block_4)
restOfItems = List.RestOfItems(list=importExcel)
python_script = Python(IN[0]=restOfItems)
# ---------- python_script.python (35 lines) ----------
# Load the Python Standard and Desi
import sys,os
from os import path
dumps_dir = path.expandvars(r'%LOCALAPPDATA%\Programs\RA\BIMRA')
sys.path.append(dumps_dir)
from ModClass import *
from RAForms import *
import clr
clr.AddReference('ProtoGeometry')
from Autodesk.DesignScript.Geometry import *

# The inputs to this node will be stored as a list in the IN variables.
data = IN[0]
CITY=[]
for a in data:
	CITY.append(a[0]) 
CITY2=list(set(CITY))
CITY2.sort()
SELCITY=multiplecombo("SelectCity",["City"],[CITY2])
TYPE=[] 
for b in data:
	if b[0]==SELCITY[0]:
		TYPE.append(b[1])
SELTYPE=multiplecombo("SelectType",["Type"],[TYPE])
SETBACKS=[]
for c in data:
	if c[0]==SELCITY[0]:
		if c[1]==SELTYPE[0]:
			SETBACKS.append(c[2])
			SETBACKS.append(c[3])
			SETBACKS.append(c[4])
			SETBACKS.append(c[5])			

# Assign your output to the OUT variable.
OUT = SETBACKS
# ----------------------------------------
plot_curve = Python(IN[0]=flatten, IN[1]=python_script)
# ---------- plot_curve.python (28 lines) ----------
# Load the Python Standard and DesignScript Libraries
import sys
import clr
clr.AddReference('ProtoGeometry')
from Autodesk.DesignScript.Geometry import *

# The inputs to this node will be stored as a list in the IN variables.
LINES = IN[0]
SETBACKS=IN[1]

POLY=PolyCurve.ByJoinedCurves(LINES,0.0001)
# Place your code below this line
SURF=Surface.ByPatch(POLY)
CEN=SURF.PointAtParameter(0.5,0.5)

PERPO=[]
POIN=[]
for a,b in zip(LINES,SETBACKS):
	PT=a.ClosestPointTo(CEN)
	VEC=Vector.ByTwoPoints(PT,CEN)
	LOF=a.Translate(VEC,b)
	VEX=LOF.Length
	ELOF=LOF.ExtendStart(VEX).ExtendEnd(VEX)
	PERPO.append(ELOF)
	POIN.append(PT.Translate(VEC,b/2))
# Assign your output to the OUT variable.

OUT = SURF,PERPO,POIN
# ----------------------------------------
complete_surface = CodeBlock(a=plot_curve) { a[0]; }
lines = CodeBlock(a=plot_curve) { a[1]; }
points = CodeBlock(a=plot_curve) { a[2]; }
innerSurface = Python(IN[0]=complete_surface, IN[1]=lines, IN[2]=points)
# ---------- innerSurface.python (16 lines) ----------
import clr
clr.AddReference('ProtoGeometry')
from Autodesk.DesignScript.Geometry import *
#The inputs to this node will be stored as a list in the IN variable.

base_surface = IN[0]
circles = IN[1]
points = IN[2]

new_base = base_surface

for i in range(len(circles)):
	new_base = new_base.Trim(circles[i], points[i])[0]

#Assign your output to the OUT variable
OUT = new_base
# ----------------------------------------
cp_chgfws = Python(IN[0]=innerSurface)
# ---------- cp_chgfws.python (60 lines) ----------
# Load the Python Standard and DesignScript Libraries
import sys
import clr
clr.AddReference('ProtoGeometry')
from Autodesk.DesignScript.Geometry import *

# The inputs to this node will be stored as a list in the IN variables.
BA_SURFACE = IN[0]
# Place your code below this line

#BUILDABLE SURFACE PERIMETER CURVES
BA_CURVES = Surface.PerimeterCurves(BA_SURFACE);
BA_HP_XVALUE_SUM=0
BA_HP_YVALUE_SUM=0

for a in BA_CURVES:
	BA_HP = a.PointAtParameter(0.5)
	BA_HP_XVALUE_SUM=BA_HP_XVALUE_SUM+BA_HP.X
	BA_HP_YVALUE_SUM=BA_HP_YVALUE_SUM+BA_HP.Y

BA_C_X = BA_HP_XVALUE_SUM/4;
BA_C_Y = BA_HP_YVALUE_SUM/4;

BA_CENTER = Point.ByCoordinates(BA_C_X, BA_C_Y, 0);
BA_POLYC= PolyCurve.ByJoinedCurves(BA_CURVES)
BA_POLYC_L=round(BA_POLYC.Length,0)

#Vector Definitions
X_A = Vector.XAxis()
Y_A = Vector.YAxis()
X_A_N = Vector.Reverse(X_A)
Y_A_N = Vector.Reverse(Y_A)
TWO_A = []
TWO_A.append(X_A)
TWO_A.append(Y_A)

D_4_A = []
D_4_A.append(X_A)
D_4_A.append(X_A_N)
D_4_A.append(Y_A)
D_4_A.append(Y_A_N)

X_P_N = []
X_P_N.append(X_A)
X_P_N.append(X_A_N)

Y_P_N = []
Y_P_N.append(Y_A)
Y_P_N.append(Y_A_N)

XYV=[]
XYV.append(X_P_N)
XYV.append(Y_P_N)

EXTENDEDLINES=[]
for a in D_4_A:
	LCD=Line.ByStartPointDirectionLength(BA_CENTER,a,BA_POLYC_L)
	EXTENDEDLINES.append(LCD)
# Assign your output to the OUT variable.
OUT = BA_CENTER,BA_CURVES,BA_POLYC,BA_POLYC_L,X_A_N,Y_A_N,X_P_N,Y_P_N,D_4_A,XYV,X_A,Y_A,EXTENDEDLINES
# ----------------------------------------
BA_Polycurve = CodeBlock(a=cp_chgfws) { a[2]; }
curves_2 = PolyCurve.Curves(polyCurve=BA_Polycurve)
byCurve = ModelCurve.ByCurve(curve=curves_2)
ba_center_point = CodeBlock(a=cp_chgfws) { a[0]; }
direction_4_axis = CodeBlock(a=cp_chgfws) { a[8]; }
VALUE_LENGTH = CodeBlock(a=cp_chgfws) { a[3]; }
GRIDCREATION = Python(IN[0]=ba_center_point, IN[1]=direction_4_axis, IN[2]=VALUE_LENGTH, IN[3]=BA_Polycurve)
# ---------- GRIDCREATION.python (27 lines) ----------
# Load the Python Standard and DesignScript Libraries
import sys
import clr
clr.AddReference('ProtoGeometry')
from Autodesk.DesignScript.Geometry import *

# The inputs to this node will be stored as a list in the IN variables.
BA_CENTER = IN[0]
D_4_A=IN[1]
VALUE_LENGTH=IN[2]
BA_POLYCURVE = IN[3]

# Place your code below this line

EXTLIN=[]
for a in D_4_A:
	LCD=Line.ByStartPointDirectionLength(BA_CENTER,a,VALUE_LENGTH)
	EXTLIN.append(LCD)
INTPOI=[]
for a in EXTLIN:
	POI=a.Intersect(BA_POLYCURVE)[0]
	INTPOI.append(POI)

LINEINTERSECT=[Line.ByStartPointEndPoint(INTPOI[0],INTPOI[1]),Line.ByStartPointEndPoint(INTPOI[2],INTPOI[3])]

# Assign your output to the OUT variable.
OUT = LINEINTERSECT
# ----------------------------------------
XAXIS = CodeBlock(a=cp_chgfws) { a[10]; }
YAXIS = CodeBlock(a=cp_chgfws) { a[11]; }
module_creation = Python(IN[0]=GRIDCREATION, IN[1]=XAXIS, IN[2]=YAXIS)
# ---------- module_creation.python (78 lines) ----------
# Load the Python Standard and DesignScript Libraries
import sys,os
from os import path
dumps_dir = path.expandvars(r'%LOCALAPPDATA%\Programs\RA\BIMRA')
sys.path.append(dumps_dir)
from ModClass import *
from RAForms import *
from LayFit import *
import clr
import math
clr.AddReference('ProtoGeometry')
from Autodesk.DesignScript.Geometry import *

Lines= IN[0]
SL=Lines[0]
LL=Lines[1] 
XVEC=IN[1]    
YVEC=IN[2]    

XGRIDS=MODGRID3(LL,SL,YVEC)
YGRIDS=MODGRID3(SL,LL,XVEC)
FORMACRO=[]
X=1
for e in range(2):
	Y=e*12
	for a,b,f in zip(XGRIDS[0],XGRIDS[1],range(int(len(XGRIDS[0])))):
		for c,d,g in zip(YGRIDS[0],YGRIDS[1],range(int(len(YGRIDS[0])))):
			M1=MOD()
			M1.IOF=X
			M1.ORI=a.Intersect(c)[0].Translate(Vector.ByCoordinates(0,0,Y)) 
			M1.WID=d
			M1.LEN=b
			M1.HEI=12
			M1.CEN=M1.ORI.Translate(Vector.ByCoordinates(0,0,M1.HEI/2))
			M1.USE=0
			M1.CSYS=CoordinateSystem.ByOriginVectors(M1.CEN,XVEC,YVEC,Vector.ByCoordinates(0,0,1))
			M1.SOL=Cuboid.ByLengths(M1.CSYS,M1.WID,M1.LEN,M1.HEI)	
			M1.VEC=Vector.ByCoordinates(0,1,0)			
			FORMACRO.append(M1)
			if f==0:
				M1.SC1=0
			else:			
				M1.SC1=((f-1)*(len(YGRIDS[0])))+g+1+(e*(len(XGRIDS[0]))*(len(YGRIDS[0])))
			if f==len(XGRIDS[0])-1:
				M1.SC3=0
			else:
				M1.SC3=((f+1)*(len(YGRIDS[0])))+g+1+(e*(len(XGRIDS[0]))*(len(YGRIDS[0])))
			if g==len(YGRIDS[0])-1:
				M1.SC2=0
			else:			
				M1.SC2=(f*(len(YGRIDS[0])))+g+2+(e*(len(XGRIDS[0]))*(len(YGRIDS[0])))
			if g==0:
				M1.SC4=0
			else:			
				M1.SC4=(f*(len(YGRIDS[0])))+g+(e*(len(XGRIDS[0]))*(len(YGRIDS[0])))
			if e==0:
				M1.SC5=0
			else:			
				M1.SC5=(f*(len(YGRIDS[0])))+g+1
			if e==1:
				M1.SC6=0
			else:			
				M1.SC6=(f*(len(YGRIDS[0])))+g+1+(len(XGRIDS[0]))*(len(YGRIDS[0]))
			X=X+1
 
SHOW=[]
for a,b in zip(FORMACRO,range(len(FORMACRO))):
	SHOW.append(a.SC1)
	SHOW.append(a.SC2)
	SHOW.append(a.SC3)
	SHOW.append(a.SC4)
	SHOW.append(a.SC5)
	SHOW.append(a.SC6)
	SHOW.append(a.IOF)
	SHOW.append(a.SOL)

# Assign your output to the OUT variable.
OUT = SHOW,range(2),len(YGRIDS[0]),FORMACRO,XGRIDS,YGRIDS
# ----------------------------------------
code_block_5 = CodeBlock(a=module_creation) { a[3]; }
WCF = Python(IN[0]=code_block_5)
# ---------- WCF.python (166 lines) ----------
# Load the Python Standard and DesignScript Libraries
import sys,os
from os import path
dumps_dir = path.expandvars(r'%LOCALAPPDATA%\Programs\RA\BIMRA')
sys.path.append(dumps_dir)
from ModClass import *
from RAForms import *
from LayFit import *
import clr
clr.AddReference('ProtoGeometry')
from Autodesk.DesignScript.Geometry import *
import System.Collections.Generic
from System.Collections.Generic import List
from System.Collections.Generic import Dictionary

# The inputs to this node will be stored as a list in the IN variables.
	
MODULES = IN[0]  
SET = len(MODULES)/2  
PROG = ARCHPROG(SET)

MACROC=[]  
MODC=[]       
SPOTS=[]     
IOFS=[]    

PRIGROU=[]
for a in MODULES:
	if a.SC5==0 and a.SC1==0:
		PRIGROU.append(a.IOF)
		
MACRONS=CMACRONSFROMPROG(PROG)
CMODOLS=CMODOLSFROMMODULES(MODULES,MACRONS,"DOWN") 

MACROC=MACRONS 
MODC=CMODOLS
SELMOD=[] 
SELPRO=[]  
SP1=[]
IO1=[]
NUMS=[]
for a in CMODOLS: 
	NUMS.append(a.IOF)

for a in PROG: 
	X=0
	IOSS=[]
	for b in MODC:
		if a in b.NAML:
			X+=1 
			IOSS.append(b.IOF) 
	IO1.append(IOSS)
	SP1.append(X) 
SPOTS=SP1
IOFS=IO1
  
#WFC
for a in range(SET): 
	ELEMENT=WCFSELECT(PROG,SPOTS,IOFS,SELMOD,SELPRO,PRIGROU,CMODOLS,NUMS)
	MACROC=WCFCOLLAPSE(PROG,MACROC,ELEMENT)	
	PROPAGATE=WCFPROPAGATE(SELMOD,SELPRO,MODC,CMODOLS,MACRONS,ELEMENT,NUMS)  
	MODC=PROPAGATE[0]
	PRIGROU=PROPAGATE[1]
	EVALS=WCFEVALUATE(PROG,MODC) 
	SPOTS=EVALS[0]
	IOFS=EVALS[1]  

CHOICE = SOCKETSAVAILABLE(CMODOLS,SELMOD,SET)
 
SUPMOD=[]
for a in MODULES:
	if a.SC6==0:
		SUPMOD.append(a.IOF)  

TBLOCK=[]
TLIV=[]
LOCBLOCKS=[]
for a,b in zip(SELPRO,SELMOD):
	if "TERRA" in a:
		TBLOCK.append(b)
	elif "LIVI" in a:
		TLIV.append(b)		
	else:
		LOCBLOCKS.append(b)
		
UPPRO=UPARCHPROG(len(LOCBLOCKS))  
SETUP=len(LOCBLOCKS)

UPLOCS=[]
T1=[]
for a in LOCBLOCKS: 
	UPLOCS.append(CEBIOF(a,CMODOLS).SOCKETS[5])
	T1.append(CEBIOF(a,CMODOLS).SOCKETS[5])
	
MACROUP=CMACRONSFROMPROG(UPPRO) 
MODUP=CMODOLSFROMMODULES(MODULES,MACROUP,"UP") 
MACROCUP=MACROUP
MODCUP=MODUP
SELMODUP=[] 
SELPROUP=[]  
SPUP=[]
IOUP=[]
for a in UPPRO: 
	X=0
	IOSS=[]
	for b in MODCUP:		
		if a in b.NAML:
			X+=1  
			IOSS.append(b.IOF)  
	IOUP.append(IOSS) 
	SPUP.append(X) 
SPOTSUP=SPUP 
IOFSUP=IOUP 
PRIGROUUP=[]
for a in range(SETUP): 
	ELEMENTUP=WCFSELECT(UPPRO,SPOTSUP,IOFSUP,SELMODUP,SELPROUP,PRIGROUUP,MODUP,UPLOCS)
	MACROCUP=WCFCOLLAPSE(UPPRO,MACROCUP,ELEMENTUP)	
	PROPAGATEUP=WCFPROPAGATE(SELMODUP,SELPROUP,MODCUP,MODUP,MACROUP,ELEMENTUP,UPLOCS)  
	MODCUP=PROPAGATEUP[0]
	PRIGROUUP=PROPAGATEUP[1]
	EVALSUP=WCFEVALUATE(UPPRO,MODCUP) 
	SPOTSUP=EVALSUP[0]
	IOFSUP=EVALSUP[1]  

UPAV=T1
REVSELS=[]
for a in SELMODUP:
	if a in UPLOCS:
		UPAV.remove(a)
		REVSELS.append(a)
	else:
		for b in UPAV:
			if b not in SELMODUP:
				REVSELS.append(b)
				UPAV.remove(b)

for a,b in zip(REVSELS,SELPROUP):
	SELMOD.append(a)
	SELPRO.append(b) 
	
for a in TLIV:
	SELMOD.append(CEBIOF(a,CMODOLS).SOCKETS[5])
	SELPRO.append("00_VOID")
	
#PROPAGATE
SHOW=[]
for a in MACROUP: 
	SHOW.append(a.NS)    
	SHOW.append(a.NAM)	 
	SHOW.append(a.SOCKETS)	    

SHOW2=[]
for a in MODCUP: 
	SHOW2.append(a.IOF)
	SHOW2.append(a.NAML)   
	SHOW2.append(a.SOCKETS)  

SHOW3=[]
for a in MODUP: 
	SHOW3.append(a.IOF)
	SHOW3.append(a.NAML)   
	SHOW3.append(a.SOCKETS)  

# Assign your output to the OUT variable.
OUT = SELMOD,SELPRO,PROG
 
# ----------------------------------------
SELMODS = CodeBlock(a=WCF) { a[0]; }
SELPRO = CodeBlock(a=WCF) { a[1]; }
REMACROWCF = Python(IN[0]=code_block_5, IN[1]=SELMODS, IN[2]=SELPRO)
# ---------- REMACROWCF.python (50 lines) ----------
# Load the Python Standard and DesignScript Libraries
import sys,os
from os import path
dumps_dir = path.expandvars(r'%LOCALAPPDATA%\Programs\RA\BIMRA')
sys.path.append(dumps_dir)
from ModClass import *
from RAForms import *
from LayFit import *
import clr
clr.AddReference('ProtoGeometry')
from Autodesk.DesignScript.Geometry import *
import System.Collections.Generic
from System.Collections.Generic import List
from System.Collections.Generic import Dictionary

# The inputs to this node will be stored as a list in the IN variables.
	
MODULES = IN[0]
LOCS= IN[1]
NAME= IN[2]
  
MODALLOC=[]
for a,b in zip(LOCS,NAME): 
	if b[3:]=="TERRACE":
		MACROF=macalloc(0,64,16,16,1,256,b[3:])
	else:
		MACROF=macalloc(0,64,16,16,12,256,b[3:])
	for c in MODULES:
		if c.IOF==a:
			MACROF=macnite(MACROF,c)
	MODALLOC.append(MACROF)
	
ALLGEOS=[] 
ALLNAMES=[]
ALLORIGINS=[]
WS=[]
HS=[]
LS=[]

for a,b in zip(MODALLOC,range(len(MODALLOC))):
	a.IOF=b+1
	ALLGEOS.append(a.SOL)
	ALLNAMES.append(a.NAM)
	ALLORIGINS.append(a.ORI)
	WS.append(a.WID)
	LS.append(a.LEN)
	HS.append(a.HEI)

# Assign your output to the OUT variable.
OUT =ALLGEOS,ALLGEOS,ALLNAMES,ALLORIGINS,WS,LS,HS,MODALLOC
# ----------------------------------------
code_block_6 = CodeBlock(a=REMACROWCF) { a; }

# group: To Revit
code_block_7 = CodeBlock { "MACROS"; }
byName = Family.ByName(name=code_block_7)
code_block_8 = CodeBlock(a=code_block_6) { a[2]; }
byFamilyAndName = FamilyType.ByFamilyAndName(family=byName, name=code_block_8)
code_block_9 = CodeBlock(a=code_block_6) { a[3]; }
byPoint = FamilyInstance.ByPoint(familyType=byFamilyAndName, point=code_block_9)
code_block_10 = CodeBlock { "HHeigth"; }
code_block_11 = CodeBlock(a=code_block_6) { a[6]; }
setParameterByName = Element.SetParameterByName(element=byPoint, parameterName=code_block_10, value=code_block_11)
code_block_12 = CodeBlock { "WWidth"; }
code_block_13 = CodeBlock(a=code_block_6) { a[5]; }
setParameterByName_2 = Element.SetParameterByName(element=byPoint, parameterName=code_block_12, value=code_block_13)
code_block_14 = CodeBlock { "LLength"; }
code_block_15 = CodeBlock(a=code_block_6) { a[4]; }
setParameterByName_3 = Element.SetParameterByName(element=byPoint, parameterName=code_block_14, value=code_block_15)

code_block_16 = CodeBlock(a=module_creation) { a[4]; }
code_block_17 = CodeBlock(a=module_creation) { a[5]; }
