# Dynamo graph 01a_Zonning Multiple.dyn (Dynamo 2.6.1.8786)

# group: INPUT CURVES
select_model_elements = DSModelElementsSelection()  # 4 picked in the model; graph input

# group: INPUTS
name = Element.Name(element=select_model_elements)
justModelLines = Python(IN[0]=name, IN[1]=select_model_elements)
# ---------- justModelLines.python (21 lines) ----------
# Load the Python Standard and DesignScript Libraries
import sys
import clr
clr.AddReference('ProtoGeometry')
from Autodesk.DesignScript.Geometry import *

# The inputs to this node will be stored as a list in the IN variables.
LNAM = IN[0]
INDEXES=[]
ELEM=IN[1]
for a,b in zip(LNAM,range(len(LNAM))):
	if "Model Lines" in a:
		INDEXES.append(b)
RELEM=[]
for a in INDEXES:
	RELEM.append(ELEM[a])	

# Place your code below this line

# Assign your output to the OUT variable.
OUT = RELEM
# ----------------------------------------

# group: Line Managment
code_block = CodeBlock { "Line Style"; }
getParameterValueByName = Element.GetParameterValueByName(element=justModelLines, parameterName=code_block)
name_2 = Element.Name(element=getParameterValueByName)
code_block_2 = CodeBlock { ["Side Line","Flunkage Line","Front Line","Rear Line"]; }
indexOf = List.IndexOf(list=name_2, element=code_block_2)
getItemAtIndex = List.GetItemAtIndex(list=justModelLines, index=indexOf)
curves = Element.Curves(element=getItemAtIndex)
flatten = List.Flatten(list=curves)

file_path = Filename(".\setbacks.xlsx")
file_from_path = FileObject(path=file_path)
code_block_3 = CodeBlock { "Hoja1"; }
code_block_4 = CodeBlock { false; }
importExcel = Data.ImportExcel(file=file_from_path, sheetName=code_block_3, readAsStrings=code_block_4, showExcel=code_block_4)
restOfItems = List.RestOfItems(list=importExcel)
python_script = Python(IN[0]=restOfItems)
# ---------- python_script.python (36 lines) ----------
# Load the Python Standard and DesignScript Libraries
import sys,os
from os import path
dumps_dir = path.expandvars(r'%LOCALAPPDATA%\Programs\RA\BIMRA')
sys.path.append(dumps_dir)
from ModClass import *
from RAForms import *
from LayFit import *
import clr
clr.AddReference('ProtoGeometry') 
from Autodesk.DesignScript.Geometry import *

# The inputs to this node will be stored as a list in the IN variables.
data = IN[0]
CITY=[]
for a in data:
	CITY.append(a[0])
CITY2=list(set(CITY))
CITY2.sort()
SELCITY=multiplecombo("SelectCity",["City"],[CITY2])
TYPE=[] 
for b in data:
	if b[0]==SELCITY[0]:
		TYPE.append(b[1])
SELTYPE=multiplecombo("SelectType",["Type"],[TYPE])
SETBACKS=[]
for c in data:
	if c[0]==SELCITY[0]:
		if c[1]==SELTYPE[0]:
			SETBACKS.append(c[2])
			SETBACKS.append(c[3])
			SETBACKS.append(c[4])
			SETBACKS.append(c[5])			

# Assign your output to the OUT variable.
OUT = SETBACKS
# ----------------------------------------
plot_curve = Python(IN[0]=flatten, IN[1]=python_script)
# ---------- plot_curve.python (28 lines) ----------
# Load the Python Standard and DesignScript Libraries
import sys
import clr
clr.AddReference('ProtoGeometry')
from Autodesk.DesignScript.Geometry import *

# The inputs to this node will be stored as a list in the IN variables.
LINES = IN[0]
SETBACKS=IN[1]

POLY=PolyCurve.ByJoinedCurves(LINES,0.0001)
# Place your code below this line
SURF=Surface.ByPatch(POLY)
CEN=SURF.PointAtParameter(0.5,0.5)

PERPO=[]
POIN=[]
for a,b in zip(LINES,SETBACKS):
	PT=a.ClosestPointTo(CEN)
	VEC=Vector.ByTwoPoints(PT,CEN)
	LOF=a.Translate(VEC,b)
	VEX=LOF.Length
	ELOF=LOF.ExtendStart(VEX).ExtendEnd(VEX)
	PERPO.append(ELOF)
	POIN.append(PT.Translate(VEC,b/2))
# Assign your output to the OUT variable.

OUT = SURF,PERPO,POIN
# ----------------------------------------
complete_surface = CodeBlock(a=plot_curve) { a[0]; }
lines = CodeBlock(a=plot_curve) { a[1]; }
points = CodeBlock(a=plot_curve) { a[2]; }
innerSurface = Python(IN[0]=complete_surface, IN[1]=lines, IN[2]=points)
# ---------- innerSurface.python (16 lines) ----------
import clr
clr.AddReference('ProtoGeometry')
from Autodesk.DesignScript.Geometry import *
#The inputs to this node will be stored as a list in the IN variable.

base_surface = IN[0]
circles = IN[1]
points = IN[2]

new_base = base_surface

for i in range(len(circles)):
	new_base = new_base.Trim(circles[i], points[i])[0]

#Assign your output to the OUT variable
OUT = new_base
# ----------------------------------------
cp_chgfws = Python(IN[0]=innerSurface)
# ---------- cp_chgfws.python (60 lines) ----------
# Load the Python Standard and DesignScript Libraries
import sys
import clr
clr.AddReference('ProtoGeometry')
from Autodesk.DesignScript.Geometry import *

# The inputs to this node will be stored as a list in the IN variables.
BA_SURFACE = IN[0]
# Place your code below this line

#BUILDABLE SURFACE PERIMETER CURVES
BA_CURVES = Surface.PerimeterCurves(BA_SURFACE);
BA_HP_XVALUE_SUM=0
BA_HP_YVALUE_SUM=0

for a in BA_CURVES:
	BA_HP = a.PointAtParameter(0.5)
	BA_HP_XVALUE_SUM=BA_HP_XVALUE_SUM+BA_HP.X
	BA_HP_YVALUE_SUM=BA_HP_YVALUE_SUM+BA_HP.Y

BA_C_X = BA_HP_XVALUE_SUM/4;
BA_C_Y = BA_HP_YVALUE_SUM/4;

BA_CENTER = Point.ByCoordinates(BA_C_X, BA_C_Y, 0);
BA_POLYC= PolyCurve.ByJoinedCurves(BA_CURVES)
BA_POLYC_L=round(BA_POLYC.Length,0)

#Vector Definitions
X_A = Vector.XAxis()
Y_A = Vector.YAxis()
X_A_N = Vector.Reverse(X_A)
Y_A_N = Vector.Reverse(Y_A)
TWO_A = []
TWO_A.append(X_A)
TWO_A.append(Y_A)

D_4_A = []
D_4_A.append(X_A)
D_4_A.append(X_A_N)
D_4_A.append(Y_A)
D_4_A.append(Y_A_N)

X_P_N = []
X_P_N.append(X_A)
X_P_N.append(X_A_N)

Y_P_N = []
Y_P_N.append(Y_A)
Y_P_N.append(Y_A_N)

XYV=[]
XYV.append(X_P_N)
XYV.append(Y_P_N)

EXTENDEDLINES=[]
for a in D_4_A:
	LCD=Line.ByStartPointDirectionLength(BA_CENTER,a,BA_POLYC_L)
	EXTENDEDLINES.append(LCD)
# Assign your output to the OUT variable.
OUT = BA_CENTER,BA_CURVES,BA_POLYC,BA_POLYC_L,X_A_N,Y_A_N,X_P_N,Y_P_N,D_4_A,XYV,X_A,Y_A,EXTENDEDLINES
# ----------------------------------------
BA_Polycurve = CodeBlock(a=cp_chgfws) { a[2]; }
curves_2 = PolyCurve.Curves(polyCurve=BA_Polycurve)
byCurve = ModelCurve.ByCurve(curve=curves_2)
code_block_5 = CodeBlock { "MACROS"; }
byName = Family.ByName(name=code_block_5)
ba_center_point = CodeBlock(a=cp_chgfws) { a[0]; }
direction_4_axis = CodeBlock(a=cp_chgfws) { a[8]; }
VALUE_LENGTH = CodeBlock(a=cp_chgfws) { a[3]; }
GRIDCREATION = Python(IN[0]=ba_center_point, IN[1]=direction_4_axis, IN[2]=VALUE_LENGTH, IN[3]=BA_Polycurve)
# ---------- GRIDCREATION.python (27 lines) ----------
# Load the Python Standard and DesignScript Libraries
import sys
import clr
clr.AddReference('ProtoGeometry')
from Autodesk.DesignScript.Geometry import *

# The inputs to this node will be stored as a list in the IN variables.
BA_CENTER = IN[0]
D_4_A=IN[1]
VALUE_LENGTH=IN[2]
BA_POLYCURVE = IN[3]

# Place your code below this line

EXTLIN=[]
for a in D_4_A:
	LCD=Line.ByStartPointDirectionLength(BA_CENTER,a,VALUE_LENGTH)
	EXTLIN.append(LCD)
INTPOI=[]
for a in EXTLIN:
	POI=a.Intersect(BA_POLYCURVE)[0]
	INTPOI.append(POI)

LINEINTERSECT=[Line.ByStartPointEndPoint(INTPOI[0],INTPOI[1]),Line.ByStartPointEndPoint(INTPOI[2],INTPOI[3])]

# Assign your output to the OUT variable.
OUT = LINEINTERSECT
# ----------------------------------------
XAXIS = CodeBlock(a=cp_chgfws) { a[10]; }
YAXIS = CodeBlock(a=cp_chgfws) { a[11]; }
module_creation = Python(IN[0]=GRIDCREATION, IN[1]=XAXIS, IN[2]=YAXIS)
# ---------- module_creation.python (79 lines) ----------
# Load the Python Standard and DesignScript Libraries
import sys,os
from os import path
dumps_dir = path.expandvars(r'%LOCALAPPDATA%\Programs\RA\BIMRA')
sys.path.append(dumps_dir)
from ModClass import *
from RAForms import *
from LayFit import *
import clr
import clr
import math
clr.AddReference('ProtoGeometry')
from Autodesk.DesignScript.Geometry import *

Lines= IN[0]
SL=Lines[0]
LL=Lines[1] 
XVEC=IN[1]    
YVEC=IN[2]    

XGRIDS=MODGRID3(LL,SL,YVEC)
YGRIDS=MODGRID3(SL,LL,XVEC)
FORMACRO=[]
X=1
for e in range(2):
	Y=e*12
	for a,b,f in zip(XGRIDS[0],XGRIDS[1],range(int(len(XGRIDS[0])))):
		for c,d,g in zip(YGRIDS[0],YGRIDS[1],range(int(len(YGRIDS[0])))):
			M1=MOD()
			M1.IOF=X
			M1.ORI=a.Intersect(c)[0].Translate(Vector.ByCoordinates(0,0,Y)) 
			M1.WID=d
			M1.LEN=b
			M1.HEI=12
			M1.CEN=M1.ORI.Translate(Vector.ByCoordinates(0,0,M1.HEI/2))
			M1.USE=0
			M1.CSYS=CoordinateSystem.ByOriginVectors(M1.CEN,XVEC,YVEC,Vector.ByCoordinates(0,0,1))
			M1.SOL=Cuboid.ByLengths(M1.CSYS,M1.WID,M1.LEN,M1.HEI)	
			M1.VEC=Vector.ByCoordinates(0,1,0)			
			FORMACRO.append(M1)
			if f==0:
				M1.SC1=0
			else:			
				M1.SC1=((f-1)*(len(YGRIDS[0])))+g+1+(e*(len(XGRIDS[0]))*(len(YGRIDS[0])))
			if f==len(XGRIDS[0])-1:
				M1.SC3=0
			else:
				M1.SC3=((f+1)*(len(YGRIDS[0])))+g+1+(e*(len(XGRIDS[0]))*(len(YGRIDS[0])))
			if g==len(YGRIDS[0])-1:
				M1.SC2=0
			else:			
				M1.SC2=(f*(len(YGRIDS[0])))+g+2+(e*(len(XGRIDS[0]))*(len(YGRIDS[0])))
			if g==0:
				M1.SC4=0
			else:			
				M1.SC4=(f*(len(YGRIDS[0])))+g+(e*(len(XGRIDS[0]))*(len(YGRIDS[0])))
			if e==0:
				M1.SC5=0
			else:			
				M1.SC5=(f*(len(YGRIDS[0])))+g+1
			if e==1:
				M1.SC6=0
			else:			
				M1.SC6=(f*(len(YGRIDS[0])))+g+1+(len(XGRIDS[0]))*(len(YGRIDS[0]))
			X=X+1
 
SHOW=[]
for a,b in zip(FORMACRO,range(len(FORMACRO))):
	SHOW.append(a.SC1)
	SHOW.append(a.SC2)
	SHOW.append(a.SC3)
	SHOW.append(a.SC4)
	SHOW.append(a.SC5)
	SHOW.append(a.SC6)
	SHOW.append(a.IOF)
	SHOW.append(a.SOL)

# Assign your output to the OUT variable.
OUT = SHOW,range(2),len(YGRIDS[0]),FORMACRO,XGRIDS,YGRIDS
# ----------------------------------------
code_block_6 = CodeBlock(a=module_creation) { a[3]; }
WCF = Python(IN[0]=code_block_6)
# ---------- WCF.python (167 lines) ----------
# Load the Python Standard and DesignScript Libraries
import sys,os
from os import path
dumps_dir = path.expandvars(r'%LOCALAPPDATA%\Programs\RA\BIMRA')
sys.path.append(dumps_dir)
from ModClass import *
from RAForms import *
from LayFit import *
import clr
import clr
clr.AddReference('ProtoGeometry')
from Autodesk.DesignScript.Geometry import *
import System.Collections.Generic
from System.Collections.Generic import List
from System.Collections.Generic import Dictionary

# The inputs to this node will be stored as a list in the IN variables.
	
MODULES = IN[0]  
SET = len(MODULES)/2  
PROG = ARCHPROG(SET)

MACROC=[]  
MODC=[]       
SPOTS=[]     
IOFS=[]    

PRIGROU=[]
for a in MODULES:
	if a.SC5==0 and a.SC1==0:
		PRIGROU.append(a.IOF)
		
MACRONS=CMACRONSFROMPROG(PROG)
CMODOLS=CMODOLSFROMMODULES(MODULES,MACRONS,"DOWN") 

MACROC=MACRONS 
MODC=CMODOLS
SELMOD=[] 
SELPRO=[]  
SP1=[]
IO1=[]
NUMS=[]
for a in CMODOLS: 
	NUMS.append(a.IOF)

for a in PROG: 
	X=0
	IOSS=[]
	for b in MODC:
		if a in b.NAML:
			X+=1 
			IOSS.append(b.IOF) 
	IO1.append(IOSS)
	SP1.append(X) 
SPOTS=SP1
IOFS=IO1
  
#WFC
for a in range(SET): 
	ELEMENT=WCFSELECT(PROG,SPOTS,IOFS,SELMOD,SELPRO,PRIGROU,CMODOLS,NUMS)
	MACROC=WCFCOLLAPSE(PROG,MACROC,ELEMENT)	
	PROPAGATE=WCFPROPAGATE(SELMOD,SELPRO,MODC,CMODOLS,MACRONS,ELEMENT,NUMS)  
	MODC=PROPAGATE[0]
	PRIGROU=PROPAGATE[1]
	EVALS=WCFEVALUATE(PROG,MODC) 
	SPOTS=EVALS[0]
	IOFS=EVALS[1]  

CHOICE = SOCKETSAVAILABLE(CMODOLS,SELMOD,SET)
 
SUPMOD=[]
for a in MODULES:
	if a.SC6==0:
		SUPMOD.append(a.IOF)  

TBLOCK=[]
TLIV=[]
LOCBLOCKS=[]
for a,b in zip(SELPRO,SELMOD):
	if "TERRA" in a:
		TBLOCK.append(b)
	elif "LIVI" in a:
		TLIV.append(b)		
	else:
		LOCBLOCKS.append(b)
		
UPPRO=UPARCHPROG(len(LOCBLOCKS))  
SETUP=len(LOCBLOCKS)

UPLOCS=[]
T1=[]
for a in LOCBLOCKS: 
	UPLOCS.append(CEBIOF(a,CMODOLS).SOCKETS[5])
	T1.append(CEBIOF(a,CMODOLS).SOCKETS[5])
	
MACROUP=CMACRONSFROMPROG(UPPRO) 
MODUP=CMODOLSFROMMODULES(MODULES,MACROUP,"UP") 
MACROCUP=MACROUP
MODCUP=MODUP
SELMODUP=[] 
SELPROUP=[]  
SPUP=[]
IOUP=[]
for a in UPPRO: 
	X=0
	IOSS=[]
	for b in MODCUP:		
		if a in b.NAML:
			X+=1  
			IOSS.append(b.IOF)  
	IOUP.append(IOSS) 
	SPUP.append(X) 
SPOTSUP=SPUP 
IOFSUP=IOUP 
PRIGROUUP=[]
for a in range(SETUP): 
	ELEMENTUP=WCFSELECT(UPPRO,SPOTSUP,IOFSUP,SELMODUP,SELPROUP,PRIGROUUP,MODUP,UPLOCS)
	MACROCUP=WCFCOLLAPSE(UPPRO,MACROCUP,ELEMENTUP)	
	PROPAGATEUP=WCFPROPAGATE(SELMODUP,SELPROUP,MODCUP,MODUP,MACROUP,ELEMENTUP,UPLOCS)  
	MODCUP=PROPAGATEUP[0]
	PRIGROUUP=PROPAGATEUP[1]
	EVALSUP=WCFEVALUATE(UPPRO,MODCUP) 
	SPOTSUP=EVALSUP[0]
	IOFSUP=EVALSUP[1]  

UPAV=T1
REVSELS=[]
for a in SELMODUP:
	if a in UPLOCS:
		UPAV.remove(a)
		REVSELS.append(a)
	else:
		for b in UPAV:
			if b not in SELMODUP:
				REVSELS.append(b)
				UPAV.remove(b)

for a,b in zip(REVSELS,SELPROUP):
	SELMOD.append(a)
	SELPRO.append(b) 
	
for a in TLIV:
	SELMOD.append(CEBIOF(a,CMODOLS).SOCKETS[5])
	SELPRO.append("00_VOID")
	
#PROPAGATE
SHOW=[]
for a in MACROUP: 
	SHOW.append(a.NS)    
	SHOW.append(a.NAM)	 
	SHOW.append(a.SOCKETS)	    

SHOW2=[]
for a in MODCUP: 
	SHOW2.append(a.IOF)
	SHOW2.append(a.NAML)   
	SHOW2.append(a.SOCKETS)  

SHOW3=[]
for a in MODUP: 
	SHOW3.append(a.IOF)
	SHOW3.append(a.NAML)   
	SHOW3.append(a.SOCKETS)  

# Assign your output to the OUT variable.
OUT = SELMOD,SELPRO,PROG
 
# ----------------------------------------
SELMODS = CodeBlock(a=WCF) { a[0]; }
SELPRO = CodeBlock(a=WCF) { a[1]; }
REMACROWCF = Python(IN[0]=code_block_6, IN[1]=SELMODS, IN[2]=SELPRO)
# ---------- REMACROWCF.python (51 lines) ----------
# Load the Python Standard and DesignScript Libraries
import sys,os
from os import path
dumps_dir = path.expandvars(r'%LOCALAPPDATA%\Programs\RA\BIMRA')
sys.path.append(dumps_dir)
from ModClass import *
from RAForms import *
from LayFit import *
import clr
import clr
clr.AddReference('ProtoGeometry')
from Autodesk.DesignScript.Geometry import *
import System.Collections.Generic
from System.Collections.Generic import List
from System.Collections.Generic import Dictionary

# The inputs to this node will be stored as a list in the IN variables.
	
MODULES = IN[0]
LOCS= IN[1]
NAME= IN[2]
  
MODALLOC=[]
for a,b in zip(LOCS,NAME): 
	if b[3:]=="TERRACE":
		MACROF=macalloc(0,64,16,16,1,256,b[3:])
	else:
		MACROF=macalloc(0,64,16,16,12,256,b[3:])
	for c in MODULES:
		if c.IOF==a:
			MACROF=macnite(MACROF,c)
	MODALLOC.append(MACROF)
	
ALLGEOS=[] 
ALLNAMES=[]
ALLORIGINS=[]
WS=[]
HS=[]
LS=[]

for a,b in zip(MODALLOC,range(len(MODALLOC))):
	a.IOF=b+1
	ALLGEOS.append(a.SOL)
	ALLNAMES.append(a.NAM)
	ALLORIGINS.append(a.ORI)
	WS.append(a.WID)
	LS.append(a.LEN)
	HS.append(a.HEI)

# Assign your output to the OUT variable.
OUT =ALLGEOS,ALLGEOS,ALLNAMES,ALLORIGINS,WS,LS,HS,MODALLOC
# ----------------------------------------
code_block_7 = CodeBlock(a=REMACROWCF) { a; }
code_block_8 = CodeBlock(a=code_block_7) { a[2]; }
byFamilyAndName = FamilyType.ByFamilyAndName(family=byName, name=code_block_8)
code_block_9 = CodeBlock(a=code_block_7) { a[3]; }
byPoint = FamilyInstance.ByPoint(familyType=byFamilyAndName, point=code_block_9)
code_block_10 = CodeBlock { "HHeigth"; }
code_block_11 = CodeBlock(a=code_block_7) { a[6]; }
setParameterByName = Element.SetParameterByName(element=byPoint, parameterName=code_block_10, value=code_block_11)
code_block_12 = CodeBlock { "WWidth"; }
code_block_13 = CodeBlock(a=code_block_7) { a[5]; }
setParameterByName_2 = Element.SetParameterByName(element=byPoint, parameterName=code_block_12, value=code_block_13)
code_block_14 = CodeBlock { "LLength"; }
code_block_15 = CodeBlock(a=code_block_7) { a[4]; }
setParameterByName_3 = Element.SetParameterByName(element=byPoint, parameterName=code_block_14, value=code_block_15)
code_block_16 = CodeBlock(a=module_creation) { a[4]; }
code_block_17 = CodeBlock(a=module_creation) { a[5]; }
code_block_18 = CodeBlock { 0; }
code_block_19 = CodeBlock { 100; }
code_block_20 = CodeBlock(a=code_block_18, b=code_block_19) { a*b; }
byCoordinates = Vector.ByCoordinates(x=code_block_20)
translate = Geometry.Translate(geometry=code_block_9, direction=byCoordinates)
code_block_21 = CodeBlock { "MACROS"; }
byName_2 = Family.ByName(name=code_block_21)
WCF_2 = Python(IN[0]=code_block_6)  # same code as WCF
SELMODS_2 = CodeBlock(a=WCF_2) { a[0]; }
SELPRO_2 = CodeBlock(a=WCF_2) { a[1]; }
REMACROWCF_2 = Python(IN[0]=code_block_6, IN[1]=SELMODS_2, IN[2]=SELPRO_2)
# ---------- REMACROWCF_2.python (50 lines) ----------
# Load the Python Standard and DesignScript Libraries
import sys,os
from os import path
dumps_dir = path.expandvars(r'%LOCALAPPDATA%\Programs\RA\BIMRA')
sys.path.append(dumps_dir)
from ModClass import *
from RAForms import *
from LayFit import *
import clr
clr.AddReference('ProtoGeometry')
from Autodesk.DesignScript.Geometry import *
import System.Collections.Generic
from System.Collections.Generic import List
from System.Collections.Generic import Dictionary

# The inputs to this node will be stored as a list in the IN variables.
	
MODULES = IN[0]
LOCS= IN[1]
NAME= IN[2]
  
MODALLOC=[]
for a,b in zip(LOCS,NAME): 
	if b[3:]=="TERRACE":
		MACROF=macalloc(0,64,16,16,1,256,b[3:])
	else:
		MACROF=macalloc(0,64,16,16,12,256,b[3:])
	for c in MODULES:
		if c.IOF==a:
			MACROF=macnite(MACROF,c)
	MODALLOC.append(MACROF)
	
ALLGEOS=[] 
ALLNAMES=[]
ALLORIGINS=[]
WS=[]
HS=[]
LS=[]

for a,b in zip(MODALLOC,range(len(MODALLOC))):
	a.IOF=b+1
	ALLGEOS.append(a.SOL)
	ALLNAMES.append(a.NAM)
	ALLORIGINS.append(a.ORI)
	WS.append(a.WID)
	LS.append(a.LEN)
	HS.append(a.HEI)

# Assign your output to the OUT variable.
OUT =ALLGEOS,ALLGEOS,ALLNAMES,ALLORIGINS,WS,LS,HS,MODALLOC
# ----------------------------------------
code_block_22 = CodeBlock(a=REMACROWCF_2) { a; }
code_block_23 = CodeBlock(a=code_block_22) { a[2]; }
byFamilyAndName_2 = FamilyType.ByFamilyAndName(family=byName_2, name=code_block_23)
code_block_24 = CodeBlock(a=code_block_22) { a[3]; }
code_block_25 = CodeBlock { 1; }
code_block_26 = CodeBlock { 100; }
code_block_27 = CodeBlock(a=code_block_25, b=code_block_26) { a*b; }
byCoordinates_2 = Vector.ByCoordinates(x=code_block_27)
translate_2 = Geometry.Translate(geometry=code_block_24, direction=byCoordinates_2)
byPoint_2 = FamilyInstance.ByPoint(familyType=byFamilyAndName_2, point=translate_2)
code_block_28 = CodeBlock { "HHeigth"; }
code_block_29 = CodeBlock(a=code_block_22) { a[6]; }
setParameterByName_4 = Element.SetParameterByName(element=byPoint_2, parameterName=code_block_28, value=code_block_29)
code_block_30 = CodeBlock { "WWidth"; }
code_block_31 = CodeBlock(a=code_block_22) { a[5]; }
setParameterByName_5 = Element.SetParameterByName(element=byPoint_2, parameterName=code_block_30, value=code_block_31)
code_block_32 = CodeBlock { "LLength"; }
code_block_33 = CodeBlock(a=code_block_22) { a[4]; }
setParameterByName_6 = Element.SetParameterByName(element=byPoint_2, parameterName=code_block_32, value=code_block_33)
code_block_34 = CodeBlock { "MACROS"; }
byName_3 = Family.ByName(name=code_block_34)
WCF_3 = Python(IN[0]=code_block_6)
# ---------- WCF_3.python (166 lines) ----------
# Load the Python Standard and DesignScript Libraries
import sys,os
from os import path
dumps_dir = path.expandvars(r'%LOCALAPPDATA%\Programs\RA\BIMRA')
sys.path.append(dumps_dir)
from ModClass import *
from RAForms import *
from LayFit import *
import clr
clr.AddReference('ProtoGeometry')
from Autodesk.DesignScript.Geometry import *
import System.Collections.Generic
from System.Collections.Generic import List
from System.Collections.Generic import Dictionary

# The inputs to this node will be stored as a list in the IN variables.
	
MODULES = IN[0]  
SET = len(MODULES)/2  
PROG = ARCHPROG(SET)

MACROC=[]  
MODC=[]       
SPOTS=[]     
IOFS=[]    

PRIGROU=[]
for a in MODULES:
	if a.SC5==0 and a.SC1==0:
		PRIGROU.append(a.IOF)
		
MACRONS=CMACRONSFROMPROG(PROG)
CMODOLS=CMODOLSFROMMODULES(MODULES,MACRONS,"DOWN") 

MACROC=MACRONS 
MODC=CMODOLS
SELMOD=[] 
SELPRO=[]  
SP1=[]
IO1=[]
NUMS=[]
for a in CMODOLS: 
	NUMS.append(a.IOF)

for a in PROG: 
	X=0
	IOSS=[]
	for b in MODC:
		if a in b.NAML:
			X+=1 
			IOSS.append(b.IOF) 
	IO1.append(IOSS)
	SP1.append(X) 
SPOTS=SP1
IOFS=IO1
  
#WFC
for a in range(SET): 
	ELEMENT=WCFSELECT(PROG,SPOTS,IOFS,SELMOD,SELPRO,PRIGROU,CMODOLS,NUMS)
	MACROC=WCFCOLLAPSE(PROG,MACROC,ELEMENT)	
	PROPAGATE=WCFPROPAGATE(SELMOD,SELPRO,MODC,CMODOLS,MACRONS,ELEMENT,NUMS)  
	MODC=PROPAGATE[0]
	PRIGROU=PROPAGATE[1]
	EVALS=WCFEVALUATE(PROG,MODC) 
	SPOTS=EVALS[0]
	IOFS=EVALS[1]  

CHOICE = SOCKETSAVAILABLE(CMODOLS,SELMOD,SET)
 
SUPMOD=[]
for a in MODULES:
	if a.SC6==0:
		SUPMOD.append(a.IOF)  

TBLOCK=[]
TLIV=[]
LOCBLOCKS=[]
for a,b in zip(SELPRO,SELMOD):
	if "TERRA" in a:
		TBLOCK.append(b)
	elif "LIVI" in a:
		TLIV.append(b)		
	else:
		LOCBLOCKS.append(b)
		
UPPRO=UPARCHPROG(len(LOCBLOCKS))  
SETUP=len(LOCBLOCKS)

UPLOCS=[]
T1=[]
for a in LOCBLOCKS: 
	UPLOCS.append(CEBIOF(a,CMODOLS).SOCKETS[5])
	T1.append(CEBIOF(a,CMODOLS).SOCKETS[5])
	
MACROUP=CMACRONSFROMPROG(UPPRO) 
MODUP=CMODOLSFROMMODULES(MODULES,MACROUP,"UP") 
MACROCUP=MACROUP
MODCUP=MODUP
SELMODUP=[] 
SELPROUP=[]  
SPUP=[]
IOUP=[]
for a in UPPRO: 
	X=0
	IOSS=[]
	for b in MODCUP:		
		if a in b.NAML:
			X+=1  
			IOSS.append(b.IOF)  
	IOUP.append(IOSS) 
	SPUP.append(X) 
SPOTSUP=SPUP 
IOFSUP=IOUP 
PRIGROUUP=[]
for a in range(SETUP): 
	ELEMENTUP=WCFSELECT(UPPRO,SPOTSUP,IOFSUP,SELMODUP,SELPROUP,PRIGROUUP,MODUP,UPLOCS)
	MACROCUP=WCFCOLLAPSE(UPPRO,MACROCUP,ELEMENTUP)	
	PROPAGATEUP=WCFPROPAGATE(SELMODUP,SELPROUP,MODCUP,MODUP,MACROUP,ELEMENTUP,UPLOCS)  
	MODCUP=PROPAGATEUP[0]
	PRIGROUUP=PROPAGATEUP[1]
	EVALSUP=WCFEVALUATE(UPPRO,MODCUP) 
	SPOTSUP=EVALSUP[0]
	IOFSUP=EVALSUP[1]  

UPAV=T1
REVSELS=[]
for a in SELMODUP:
	if a in UPLOCS:
		UPAV.remove(a)
		REVSELS.append(a)
	else:
		for b in UPAV:
			if b not in SELMODUP:
				REVSELS.append(b)
				UPAV.remove(b)

for a,b in zip(REVSELS,SELPROUP):
	SELMOD.append(a)
	SELPRO.append(b) 
	
for a in TLIV:
	SELMOD.append(CEBIOF(a,CMODOLS).SOCKETS[5])
	SELPRO.append("00_VOID")
	
#PROPAGATE
SHOW=[]
for a in MACROUP: 
	SHOW.append(a.NS)    
	SHOW.append(a.NAM)	 
	SHOW.append(a.SOCKETS)	    

SHOW2=[]
for a in MODCUP: 
	SHOW2.append(a.IOF)
	SHOW2.append(a.NAML)   
	SHOW2.append(a.SOCKETS)  

SHOW3=[]
for a in MODUP: 
	SHOW3.append(a.IOF)
	SHOW3.append(a.NAML)   
	SHOW3.append(a.SOCKETS)  

# Assign your output to the OUT variable.
OUT = SELMOD,SELPRO,PROG
 
# ----------------------------------------
SELMODS_3 = CodeBlock(a=WCF_3) { a[0]; }
SELPRO_3 = CodeBlock(a=WCF_3) { a[1]; }
REMACROWCF_3 = Python(IN[0]=code_block_6, IN[1]=SELMODS_3, IN[2]=SELPRO_3)  # same code as REMACROWCF_2
code_block_35 = CodeBlock(a=REMACROWCF_3) { a; }
code_block_36 = CodeBlock(a=code_block_35) { a[2]; }
byFamilyAndName_3 = FamilyType.ByFamilyAndName(family=byName_3, name=code_block_36)
code_block_37 = CodeBlock(a=code_block_35) { a[3]; }
code_block_38 = CodeBlock { 4; }
code_block_39 = CodeBlock { 100; }
code_block_40 = CodeBlock(a=code_block_38, b=code_block_39) { a*b; }
byCoordinates_3 = Vector.ByCoordinates(x=code_block_40)
translate_3 = Geometry.Translate(geometry=code_block_37, direction=byCoordinates_3)
byPoint_3 = FamilyInstance.ByPoint(familyType=byFamilyAndName_3, point=translate_3)
code_block_41 = CodeBlock { "HHeigth"; }
code_block_42 = CodeBlock(a=code_block_35) { a[6]; }
setParameterByName_7 = Element.SetParameterByName(element=byPoint_3, parameterName=code_block_41, value=code_block_42)
code_block_43 = CodeBlock { "WWidth"; }
code_block_44 = CodeBlock(a=code_block_35) { a[5]; }
setParameterByName_8 = Element.SetParameterByName(element=byPoint_3, parameterName=code_block_43, value=code_block_44)
code_block_45 = CodeBlock { "LLength"; }
code_block_46 = CodeBlock(a=code_block_35) { a[4]; }
setParameterByName_9 = Element.SetParameterByName(element=byPoint_3, parameterName=code_block_45, value=code_block_46)
code_block_47 = CodeBlock { "MACROS"; }
byName_4 = Family.ByName(name=code_block_47)
WCF_4 = Python(IN[0]=code_block_6)  # same code as WCF_3
SELMODS_4 = CodeBlock(a=WCF_4) { a[0]; }
SELPRO_4 = CodeBlock(a=WCF_4) { a[1]; }
REMACROWCF_4 = Python(IN[0]=code_block_6, IN[1]=SELMODS_4, IN[2]=SELPRO_4)  # same code as REMACROWCF_2
code_block_48 = CodeBlock(a=REMACROWCF_4) { a; }
code_block_49 = CodeBlock(a=code_block_48) { a[2]; }
byFamilyAndName_4 = FamilyType.ByFamilyAndName(family=byName_4, name=code_block_49)
code_block_50 = CodeBlock(a=code_block_48) { a[3]; }
code_block_51 = CodeBlock { 5; }
code_block_52 = CodeBlock { 100; }
code_block_53 = CodeBlock(a=code_block_51, b=code_block_52) { a*b; }
byCoordinates_4 = Vector.ByCoordinates(x=code_block_53)
translate_4 = Geometry.Translate(geometry=code_block_50, direction=byCoordinates_4)
byPoint_4 = FamilyInstance.ByPoint(familyType=byFamilyAndName_4, point=translate_4)
code_block_54 = CodeBlock { "HHeigth"; }
code_block_55 = CodeBlock(a=code_block_48) { a[6]; }
setParameterByName_10 = Element.SetParameterByName(element=byPoint_4, parameterName=code_block_54, value=code_block_55)
code_block_56 = CodeBlock { "WWidth"; }
code_block_57 = CodeBlock(a=code_block_48) { a[5]; }
setParameterByName_11 = Element.SetParameterByName(element=byPoint_4, parameterName=code_block_56, value=code_block_57)
code_block_58 = CodeBlock { "LLength"; }
code_block_59 = CodeBlock(a=code_block_48) { a[4]; }
setParameterByName_12 = Element.SetParameterByName(element=byPoint_4, parameterName=code_block_58, value=code_block_59)
code_block_60 = CodeBlock { "MACROS"; }
byName_5 = Family.ByName(name=code_block_60)
WCF_5 = Python(IN[0]=code_block_6)  # same code as WCF_3
SELMODS_5 = CodeBlock(a=WCF_5) { a[0]; }
SELPRO_5 = CodeBlock(a=WCF_5) { a[1]; }
REMACROWCF_5 = Python(IN[0]=code_block_6, IN[1]=SELMODS_5, IN[2]=SELPRO_5)  # same code as REMACROWCF_2
code_block_61 = CodeBlock(a=REMACROWCF_5) { a; }
code_block_62 = CodeBlock(a=code_block_61) { a[2]; }
byFamilyAndName_5 = FamilyType.ByFamilyAndName(family=byName_5, name=code_block_62)
code_block_63 = CodeBlock(a=code_block_61) { a[3]; }
code_block_64 = CodeBlock { 8; }
code_block_65 = CodeBlock { 100; }
code_block_66 = CodeBlock(a=code_block_64, b=code_block_65) { a*b; }
byCoordinates_5 = Vector.ByCoordinates(x=code_block_66)
translate_5 = Geometry.Translate(geometry=code_block_63, direction=byCoordinates_5)
byPoint_5 = FamilyInstance.ByPoint(familyType=byFamilyAndName_5, point=translate_5)
code_block_67 = CodeBlock { "LLength"; }
code_block_68 = CodeBlock(a=code_block_61) { a[4]; }
setParameterByName_13 = Element.SetParameterByName(element=byPoint_5, parameterName=code_block_67, value=code_block_68)
code_block_69 = CodeBlock { "WWidth"; }
code_block_70 = CodeBlock(a=code_block_61) { a[5]; }
setParameterByName_14 = Element.SetParameterByName(element=byPoint_5, parameterName=code_block_69, value=code_block_70)
code_block_71 = CodeBlock { "HHeigth"; }
code_block_72 = CodeBlock(a=code_block_61) { a[6]; }
setParameterByName_15 = Element.SetParameterByName(element=byPoint_5, parameterName=code_block_71, value=code_block_72)
code_block_73 = CodeBlock { "MACROS"; }
byName_6 = Family.ByName(name=code_block_73)
WCF_6 = Python(IN[0]=code_block_6)  # same code as WCF_3
SELMODS_6 = CodeBlock(a=WCF_6) { a[0]; }
SELPRO_6 = CodeBlock(a=WCF_6) { a[1]; }
REMACROWCF_6 = Python(IN[0]=code_block_6, IN[1]=SELMODS_6, IN[2]=SELPRO_6)  # same code as REMACROWCF_2
code_block_74 = CodeBlock(a=REMACROWCF_6) { a; }
code_block_75 = CodeBlock(a=code_block_74) { a[2]; }
byFamilyAndName_6 = FamilyType.ByFamilyAndName(family=byName_6, name=code_block_75)
code_block_76 = CodeBlock(a=code_block_74) { a[3]; }
code_block_77 = CodeBlock { 9; }
code_block_78 = CodeBlock { 100; }
code_block_79 = CodeBlock(a=code_block_77, b=code_block_78) { a*b; }
byCoordinates_6 = Vector.ByCoordinates(x=code_block_79)
translate_6 = Geometry.Translate(geometry=code_block_76, direction=byCoordinates_6)
byPoint_6 = FamilyInstance.ByPoint(familyType=byFamilyAndName_6, point=translate_6)
code_block_80 = CodeBlock { "LLength"; }
code_block_81 = CodeBlock(a=code_block_74) { a[4]; }
setParameterByName_16 = Element.SetParameterByName(element=byPoint_6, parameterName=code_block_80, value=code_block_81)
code_block_82 = CodeBlock { "WWidth"; }
code_block_83 = CodeBlock(a=code_block_74) { a[5]; }
setParameterByName_17 = Element.SetParameterByName(element=byPoint_6, parameterName=code_block_82, value=code_block_83)
code_block_84 = CodeBlock { "HHeigth"; }
code_block_85 = CodeBlock(a=code_block_74) { a[6]; }
setParameterByName_18 = Element.SetParameterByName(element=byPoint_6, parameterName=code_block_84, value=code_block_85)
code_block_86 = CodeBlock { "MACROS"; }
byName_7 = Family.ByName(name=code_block_86)
WCF_7 = Python(IN[0]=code_block_6)  # same code as WCF_3
SELMODS_7 = CodeBlock(a=WCF_7) { a[0]; }
SELPRO_7 = CodeBlock(a=WCF_7) { a[1]; }
REMACROWCF_7 = Python(IN[0]=code_block_6, IN[1]=SELMODS_7, IN[2]=SELPRO_7)  # same code as REMACROWCF_2
code_block_87 = CodeBlock(a=REMACROWCF_7) { a; }
code_block_88 = CodeBlock(a=code_block_87) { a[2]; }
byFamilyAndName_7 = FamilyType.ByFamilyAndName(family=byName_7, name=code_block_88)
code_block_89 = CodeBlock(a=code_block_87) { a[3]; }
code_block_90 = CodeBlock { 10; }
code_block_91 = CodeBlock { 100; }
code_block_92 = CodeBlock(a=code_block_90, b=code_block_91) { a*b; }
byCoordinates_7 = Vector.ByCoordinates(x=code_block_92)
translate_7 = Geometry.Translate(geometry=code_block_89, direction=byCoordinates_7)
byPoint_7 = FamilyInstance.ByPoint(familyType=byFamilyAndName_7, point=translate_7)
code_block_93 = CodeBlock { "HHeigth"; }
code_block_94 = CodeBlock(a=code_block_87) { a[6]; }
setParameterByName_19 = Element.SetParameterByName(element=byPoint_7, parameterName=code_block_93, value=code_block_94)
code_block_95 = CodeBlock { "MACROS"; }
byName_8 = Family.ByName(name=code_block_95)
WCF_8 = Python(IN[0]=code_block_6)  # same code as WCF_3
SELMODS_8 = CodeBlock(a=WCF_8) { a[0]; }
SELPRO_8 = CodeBlock(a=WCF_8) { a[1]; }
REMACROWCF_8 = Python(IN[0]=code_block_6, IN[1]=SELMODS_8, IN[2]=SELPRO_8)  # same code as REMACROWCF_2
code_block_96 = CodeBlock(a=REMACROWCF_8) { a; }
code_block_97 = CodeBlock(a=code_block_96) { a[2]; }
byFamilyAndName_8 = FamilyType.ByFamilyAndName(family=byName_8, name=code_block_97)
code_block_98 = CodeBlock(a=code_block_96) { a[3]; }
code_block_99 = CodeBlock { 6; }
code_block_100 = CodeBlock { 100; }
code_block_101 = CodeBlock(a=code_block_99, b=code_block_100) { a*b; }
byCoordinates_8 = Vector.ByCoordinates(x=code_block_101)
translate_8 = Geometry.Translate(geometry=code_block_98, direction=byCoordinates_8)
byPoint_8 = FamilyInstance.ByPoint(familyType=byFamilyAndName_8, point=translate_8)
code_block_102 = CodeBlock { "HHeigth"; }
code_block_103 = CodeBlock(a=code_block_96) { a[6]; }
setParameterByName_20 = Element.SetParameterByName(element=byPoint_8, parameterName=code_block_102, value=code_block_103)
code_block_104 = CodeBlock { "WWidth"; }
code_block_105 = CodeBlock(a=code_block_96) { a[5]; }
setParameterByName_21 = Element.SetParameterByName(element=byPoint_8, parameterName=code_block_104, value=code_block_105)
code_block_106 = CodeBlock { "WWidth"; }
code_block_107 = CodeBlock(a=code_block_87) { a[5]; }
setParameterByName_22 = Element.SetParameterByName(element=byPoint_7, parameterName=code_block_106, value=code_block_107)
code_block_108 = CodeBlock { "MACROS"; }
byName_9 = Family.ByName(name=code_block_108)
WCF_9 = Python(IN[0]=code_block_6)  # same code as WCF_3
SELMODS_9 = CodeBlock(a=WCF_9) { a[0]; }
SELPRO_9 = CodeBlock(a=WCF_9) { a[1]; }
REMACROWCF_9 = Python(IN[0]=code_block_6, IN[1]=SELMODS_9, IN[2]=SELPRO_9)  # same code as REMACROWCF_2
code_block_109 = CodeBlock(a=REMACROWCF_9) { a; }
code_block_110 = CodeBlock(a=code_block_109) { a[2]; }
byFamilyAndName_9 = FamilyType.ByFamilyAndName(family=byName_9, name=code_block_110)
code_block_111 = CodeBlock(a=code_block_109) { a[3]; }
code_block_112 = CodeBlock { 2; }
code_block_113 = CodeBlock { 100; }
code_block_114 = CodeBlock(a=code_block_112, b=code_block_113) { a*b; }
byCoordinates_9 = Vector.ByCoordinates(x=code_block_114)
translate_9 = Geometry.Translate(geometry=code_block_111, direction=byCoordinates_9)
byPoint_9 = FamilyInstance.ByPoint(familyType=byFamilyAndName_9, point=translate_9)
code_block_115 = CodeBlock { "HHeigth"; }
code_block_116 = CodeBlock(a=code_block_109) { a[6]; }
setParameterByName_23 = Element.SetParameterByName(element=byPoint_9, parameterName=code_block_115, value=code_block_116)
code_block_117 = CodeBlock { "WWidth"; }
code_block_118 = CodeBlock(a=code_block_109) { a[5]; }
setParameterByName_24 = Element.SetParameterByName(element=byPoint_9, parameterName=code_block_117, value=code_block_118)
code_block_119 = CodeBlock { "LLength"; }
code_block_120 = CodeBlock(a=code_block_109) { a[4]; }
setParameterByName_25 = Element.SetParameterByName(element=byPoint_9, parameterName=code_block_119, value=code_block_120)
code_block_121 = CodeBlock { "LLength"; }
code_block_122 = CodeBlock(a=code_block_96) { a[4]; }
setParameterByName_26 = Element.SetParameterByName(element=byPoint_8, parameterName=code_block_121, value=code_block_122)
code_block_123 = CodeBlock { "LLength"; }
code_block_124 = CodeBlock(a=code_block_87) { a[4]; }
setParameterByName_27 = Element.SetParameterByName(element=byPoint_7, parameterName=code_block_123, value=code_block_124)
code_block_125 = CodeBlock { "MACROS"; }
byName_10 = Family.ByName(name=code_block_125)
WCF_10 = Python(IN[0]=code_block_6)  # same code as WCF_3
SELMODS_10 = CodeBlock(a=WCF_10) { a[0]; }
SELPRO_10 = CodeBlock(a=WCF_10) { a[1]; }
REMACROWCF_10 = Python(IN[0]=code_block_6, IN[1]=SELMODS_10, IN[2]=SELPRO_10)  # same code as REMACROWCF_2
code_block_126 = CodeBlock(a=REMACROWCF_10) { a; }
code_block_127 = CodeBlock(a=code_block_126) { a[2]; }
byFamilyAndName_10 = FamilyType.ByFamilyAndName(family=byName_10, name=code_block_127)
code_block_128 = CodeBlock(a=code_block_126) { a[3]; }
code_block_129 = CodeBlock { 11; }
code_block_130 = CodeBlock { 100; }
code_block_131 = CodeBlock(a=code_block_129, b=code_block_130) { a*b; }
byCoordinates_10 = Vector.ByCoordinates(x=code_block_131)
translate_10 = Geometry.Translate(geometry=code_block_128, direction=byCoordinates_10)
byPoint_10 = FamilyInstance.ByPoint(familyType=byFamilyAndName_10, point=translate_10)
code_block_132 = CodeBlock { "HHeigth"; }
code_block_133 = CodeBlock(a=code_block_126) { a[6]; }
setParameterByName_28 = Element.SetParameterByName(element=byPoint_10, parameterName=code_block_132, value=code_block_133)
code_block_134 = CodeBlock { "MACROS"; }
byName_11 = Family.ByName(name=code_block_134)
WCF_11 = Python(IN[0]=code_block_6)  # same code as WCF_3
SELMODS_11 = CodeBlock(a=WCF_11) { a[0]; }
SELPRO_11 = CodeBlock(a=WCF_11) { a[1]; }
REMACROWCF_11 = Python(IN[0]=code_block_6, IN[1]=SELMODS_11, IN[2]=SELPRO_11)  # same code as REMACROWCF_2
code_block_135 = CodeBlock(a=REMACROWCF_11) { a; }
code_block_136 = CodeBlock(a=code_block_135) { a[2]; }
byFamilyAndName_11 = FamilyType.ByFamilyAndName(family=byName_11, name=code_block_136)
code_block_137 = CodeBlock(a=code_block_135) { a[3]; }
code_block_138 = CodeBlock { 7; }
code_block_139 = CodeBlock { 100; }
code_block_140 = CodeBlock(a=code_block_138, b=code_block_139) { a*b; }
byCoordinates_11 = Vector.ByCoordinates(x=code_block_140)
translate_11 = Geometry.Translate(geometry=code_block_137, direction=byCoordinates_11)
byPoint_11 = FamilyInstance.ByPoint(familyType=byFamilyAndName_11, point=translate_11)
code_block_141 = CodeBlock { "HHeigth"; }
code_block_142 = CodeBlock(a=code_block_135) { a[6]; }
setParameterByName_29 = Element.SetParameterByName(element=byPoint_11, parameterName=code_block_141, value=code_block_142)
code_block_143 = CodeBlock { "WWidth"; }
code_block_144 = CodeBlock(a=code_block_135) { a[5]; }
setParameterByName_30 = Element.SetParameterByName(element=byPoint_11, parameterName=code_block_143, value=code_block_144)
code_block_145 = CodeBlock { "WWidth"; }
code_block_146 = CodeBlock(a=code_block_126) { a[5]; }
setParameterByName_31 = Element.SetParameterByName(element=byPoint_10, parameterName=code_block_145, value=code_block_146)
code_block_147 = CodeBlock { "MACROS"; }
byName_12 = Family.ByName(name=code_block_147)
WCF_12 = Python(IN[0]=code_block_6)  # same code as WCF_3
SELMODS_12 = CodeBlock(a=WCF_12) { a[0]; }
SELPRO_12 = CodeBlock(a=WCF_12) { a[1]; }
REMACROWCF_12 = Python(IN[0]=code_block_6, IN[1]=SELMODS_12, IN[2]=SELPRO_12)  # same code as REMACROWCF_2
code_block_148 = CodeBlock(a=REMACROWCF_12) { a; }
code_block_149 = CodeBlock(a=code_block_148) { a[2]; }
byFamilyAndName_12 = FamilyType.ByFamilyAndName(family=byName_12, name=code_block_149)
code_block_150 = CodeBlock(a=code_block_148) { a[3]; }
code_block_151 = CodeBlock { 3; }
code_block_152 = CodeBlock { 100; }
code_block_153 = CodeBlock(a=code_block_151, b=code_block_152) { a*b; }
byCoordinates_12 = Vector.ByCoordinates(x=code_block_153)
translate_12 = Geometry.Translate(geometry=code_block_150, direction=byCoordinates_12)
byPoint_12 = FamilyInstance.ByPoint(familyType=byFamilyAndName_12, point=translate_12)
code_block_154 = CodeBlock { "HHeigth"; }
code_block_155 = CodeBlock(a=code_block_148) { a[6]; }
setParameterByName_32 = Element.SetParameterByName(element=byPoint_12, parameterName=code_block_154, value=code_block_155)
code_block_156 = CodeBlock { "WWidth"; }
code_block_157 = CodeBlock(a=code_block_148) { a[5]; }
setParameterByName_33 = Element.SetParameterByName(element=byPoint_12, parameterName=code_block_156, value=code_block_157)
code_block_158 = CodeBlock { "LLength"; }
code_block_159 = CodeBlock(a=code_block_148) { a[4]; }
setParameterByName_34 = Element.SetParameterByName(element=byPoint_12, parameterName=code_block_158, value=code_block_159)
code_block_160 = CodeBlock { "LLength"; }
code_block_161 = CodeBlock(a=code_block_135) { a[4]; }
setParameterByName_35 = Element.SetParameterByName(element=byPoint_11, parameterName=code_block_160, value=code_block_161)
code_block_162 = CodeBlock { "LLength"; }
code_block_163 = CodeBlock(a=code_block_126) { a[4]; }
setParameterByName_36 = Element.SetParameterByName(element=byPoint_10, parameterName=code_block_162, value=code_block_163)
