# Dynamo graph 04_Circulations.dyn (Dynamo 2.3.0.5885)

family_types = FamilyTypes("CIRCULANT:CIRCULANT")
categories = Categories("OST_SpecialityEquipment")
all_elements_of_category = ElementsOfCategory(Category=categories)
code_block = CodeBlock { "Type"; }
getParameterValueByName = Element.GetParameterValueByName(element=all_elements_of_category, parameterName=code_block)
code_block_2 = CodeBlock { "Name"; }
getParameterValueByName_2 = Element.GetParameterValueByName(element=getParameterValueByName, parameterName=code_block_2)
getLocation = Element.GetLocation(element=all_elements_of_category)
code_block_3 = CodeBlock { "TWidth"; }
getParameterValueByName_3 = Element.GetParameterValueByName(element=all_elements_of_category, parameterName=code_block_3)
code_block_4 = CodeBlock { "TLength"; }
getParameterValueByName_4 = Element.GetParameterValueByName(element=all_elements_of_category, parameterName=code_block_4)
code_block_5 = CodeBlock { "THeigth"; }
getParameterValueByName_5 = Element.GetParameterValueByName(element=all_elements_of_category, parameterName=code_block_5)
python_script = Python(IN[0]=getParameterValueByName_2, IN[1]=getLocation, IN[2]=getParameterValueByName_3, IN[3]=getParameterValueByName_4, IN[4]=getParameterValueByName_5)
# ---------- python_script.python (28 lines) ----------
# Load the Python Standard and DesignScript Libraries
import sys,os
from os import path
dumps_dir = path.expandvars(r'%ProgramW6432%\Dynamo\RA\BIMRA')
sys.path.append(dumps_dir)
from ModClass import *
from RAForms import *
from LayFit import *
import clr
clr.AddReference('ProtoGeometry')
from Autodesk.DesignScript.Geometry import *

# The inputs to this node will be stored as a list in the IN variables.
Name=IN[0]
Point=IN[1]
Width=IN[2]
Length=IN[3] 
Heigth=IN[4]
MACROS=[]

for a,b,c,d,e,f in zip(Name,Point,Length,Width,Heigth,range(len(Name))):
	MACROS.append(selfmacro(a,b,c,d,e,f))
	 
SOLS=[]	
for a in MACROS:
	SOLS.append(a.SOL)
# Assign your output to the OUT variable.
OUT = MACROS
# ----------------------------------------
MODIF = Python(IN[0]=python_script)
# ---------- MODIF.python (41 lines) ----------
# Load the Python Standard and DesignScript Libraries
import sys,os
from os import path
dumps_dir = path.expandvars(r'%ProgramW6432%\Dynamo\RA\BIMRA')
sys.path.append(dumps_dir)
from ModClass import *
from RAForms import *
from LayFit import *
import clr
clr.AddReference('ProtoGeometry')
from Autodesk.DesignScript.Geometry import *

MACROS=IN[0]
 
LOWERMODS=[]  
UPPERMODS=[]
ROOFMODS=[] 
ZVALUES=[] 
#Get the Upper Floor Rooms
for a in MACROS:
	if round(a.ORI.Z,0)==12:
		if a.NAM!="BALCONY":
			ROOFMODS.append(a)
			if a.NAM!="VOID":
				if a.NAM=="BATH":
					BATHR=MACROCONFIG("BATH",a)
					for b in BATHR[0]:
						UPPERMODS.append(b)
				else:
					UPPERMODS.append(a)
	else:
		if a.NAM!="TERRACE":
			if a.NAM=="ENTRANCE":
				ENTRANCER=MACROCONFIG("ENTRANCE",a)
				for b in ENTRANCER[0]:
					LOWERMODS.append(b)	
			else:					
				LOWERMODS.append(a)
				 
# Assign your output to the OUT variable.
OUT = ROOFMODS,UPPERMODS,LOWERMODS
# ----------------------------------------
ROADS = Python(IN[0]=MODIF)
# ---------- ROADS.python (45 lines) ----------
# Load the Python Standard and DesignScript Libraries
import sys,os
from os import path
dumps_dir = path.expandvars(r'%ProgramW6432%\Dynamo\RA\BIMRA')
sys.path.append(dumps_dir)
from ModClass import *
from RAForms import *
from LayFit import *
import clr
clr.AddReference('ProtoGeometry')
from Autodesk.DesignScript.Geometry import *

# The inputs to this node will be stored as a list in the IN variables.
MACROS = IN[0]

UPPCIR=CirculationPath(MACROS[1]) 

LINES=UPPCIR[0].Curves()
NL=[]
for a in LINES:
	LN=a.Translate(Vector.ByTwoPoints(UPPCIR[1],a.PointAtParameter(0.5)),2)
	NL.append(LN)

"""
SPOI=[]
for a in range(len(NL)):
	if a<len(NL)-1:
		SPOI.append(NL[a].StartPoint)
		PLANE=Plane.ByLineAndPoint(TOL(NL[a+1]),NL[a+1].PointAtParameter(0.5).Translate(Vector.ByCoordinates(0,0,2)))
		SPOI.append(NL[a].EndPoint.Project(PLANE,TOL(NL[a]).Direction)[0])
	else:
		SPOI.append(NL[a].EndPoint)	

FLINES=[]
for a in range(len(SPOI)):
	if a<len(SPOI)-2:
	 	FLINES.append(Line.ByStartPointEndPoint(SPOI[a],SPOI[a+1]))
	elif a<len(SPOI)-1:
		FLINES.append(Line.ByStartPointEndPoint(SPOI[a],SPOI[a+1].Translate(Vector.ByTwoPoints(SPOI[a],SPOI[a+1]),2)))
"""	 	
#FCURVE=PolyCurve.ByJoinedCurves(FLINES)	 
#Pol=PolyCurve.ByJoinedCurves(NL)
# Assign your output to the OUT variable.
OUT = NL
      
# ----------------------------------------
code_block_6 = CodeBlock { 0; }
pointAtParameter = Curve.PointAtParameter(curve=ROADS, param=code_block_6)
code_block_7 = CodeBlock { 1; }
byCoordinates = Vector.ByCoordinates(z=code_block_7)
translate = Geometry.Translate(geometry=pointAtParameter, direction=byCoordinates)
byPoint = FamilyInstance.ByPoint(familyType=family_types, point=translate)
python_script_2 = Python(IN[0]=ROADS)
# ---------- python_script_2.python (20 lines) ----------
# Load the Python Standard and DesignScript Libraries
import sys,os
from os import path
dumps_dir = path.expandvars(r'%ProgramW6432%\Dynamo\RA\BIMRA')
sys.path.append(dumps_dir)
from ModClass import *
from RAForms import *
from LayFit import *
import clr
clr.AddReference('ProtoGeometry')
from Autodesk.DesignScript.Geometry import *

# The inputs to this node will be stored as a list in the IN variables.
curves= IN[0]

LL=[]
for a in curves:
	LL.append(TOL(a))
# Assign your output to the OUT variable.
OUT = LL
# ----------------------------------------
direction = Line.Direction(line=python_script_2)
X = Vector.X(vector=direction)
Y = Vector.Y(vector=direction)
byCoordinates_2 = Vector.ByCoordinates(x=X, y=Y)
Y_2 = Vector.Y(vector=byCoordinates_2)
code_block_8 = CodeBlock { 0; }
gt = Y_2 > code_block_8
code_block_9 = CodeBlock { 1; }
byCoordinates_3 = Vector.ByCoordinates(x=code_block_9)
angleWithVector = Vector.AngleWithVector(vector=byCoordinates_3, otherVector=byCoordinates_2)
code_block_10 = CodeBlock(a=angleWithVector) { a*-1; }
if_ = If(test=gt, true=code_block_10, false=angleWithVector)
setRotation = FamilyInstance.SetRotation(familyInstance=byPoint, degree=if_)
code_block_11 = CodeBlock { "Length"; }
length = Curve.Length(curve=ROADS)
setParameterByName = Element.SetParameterByName(element=setRotation, parameterName=code_block_11, value=length)
