# Dynamo graph 06_WallsWinDoors.dyn (Dynamo 2.3.0.5885)

categories = Categories("OST_SpecialityEquipment")
all_elements_of_category = ElementsOfCategory(Category=categories)
code_block = CodeBlock { "Type"; }
getParameterValueByName = Element.GetParameterValueByName(element=all_elements_of_category, parameterName=code_block)
code_block_2 = CodeBlock { "Name"; }
getParameterValueByName_2 = Element.GetParameterValueByName(element=getParameterValueByName, parameterName=code_block_2)
getLocation = Element.GetLocation(element=all_elements_of_category)
code_block_3 = CodeBlock { "TWidth"; }
getParameterValueByName_3 = Element.GetParameterValueByName(element=all_elements_of_category, parameterName=code_block_3)
code_block_4 = CodeBlock { "TLength"; }
getParameterValueByName_4 = Element.GetParameterValueByName(element=all_elements_of_category, parameterName=code_block_4)
code_block_5 = CodeBlock { "THeigth"; }
getParameterValueByName_5 = Element.GetParameterValueByName(element=all_elements_of_category, parameterName=code_block_5)
python_script = Python(IN[0]=getParameterValueByName_2, IN[1]=getLocation, IN[2]=getParameterValueByName_3, IN[3]=getParameterValueByName_4, IN[4]=getParameterValueByName_5)
# ---------- python_script.python (28 lines) ----------
# Load the Python Standard and DesignScript Libraries
import sys,os
from os import path
dumps_dir = path.expandvars(r'%ProgramW6432%\Dynamo\RA\BIMRA')
sys.path.append(dumps_dir)
from ModClass import *
from RAForms import *
from LayFit import *
import clr
clr.AddReference('ProtoGeometry')
from Autodesk.DesignScript.Geometry import *

# The inputs to this node will be stored as a list in the IN variables.
Name=IN[0]
Point=IN[1]
Width=IN[2]
Length=IN[3] 
Heigth=IN[4]
MACROS=[]

for a,b,c,d,e,f in zip(Name,Point,Length,Width,Heigth,range(len(Name))):
	MACROS.append(selfmacro(a,b,c,d,e,f))
	 
SOLS=[]	
for a in MACROS:
	SOLS.append(a.SOL)
# Assign your output to the OUT variable.
OUT = MACROS
# ----------------------------------------
MODIF = Python(IN[0]=python_script)
# ---------- MODIF.python (31 lines) ----------
# Load the Python Standard and DesignScript Libraries
import sys,os
from os import path
dumps_dir = path.expandvars(r'%ProgramW6432%\Dynamo\RA\BIMRA')
sys.path.append(dumps_dir)
from ModClass import *
from RAForms import *
from LayFit import *
import clr
clr.AddReference('ProtoGeometry')
from Autodesk.DesignScript.Geometry import *

MACROS=IN[0]
 
LOWERMODS=[]  
UPPERMODS=[]
ROOFMODS=[] 
ZVALUES=[] 
#Get the Upper Floor Rooms
for a in MACROS:
	if round(a.ORI.Z,0)==12:
		if a.NAM!="BALCONY":
			ROOFMODS.append(a)
			if a.NAM!="VOID":
				UPPERMODS.append(a)
	else:
		if a.NAM!="TERRACE":
			LOWERMODS.append(a)	
				 
# Assign your output to the OUT variable.
OUT = ROOFMODS,UPPERMODS,LOWERMODS
# ----------------------------------------
ROOFMODS = CodeBlock(a=MODIF) { a[0]; }
UPPERMODS = CodeBlock(a=MODIF) { a[1]; }
LOWERMODS = CodeBlock(a=MODIF) { a[2]; }
create_of_floors_and_walls = Python(IN[0]=ROOFMODS, IN[1]=UPPERMODS, IN[2]=LOWERMODS)
# ---------- create_of_floors_and_walls.python (63 lines) ----------
# Load the Python Standard and DesignScript Libraries
import sys,os
from os import path
dumps_dir = path.expandvars(r'%ProgramW6432%\Dynamo\RA\BIMRA')
sys.path.append(dumps_dir)
from ModClass import *
from RAForms import *
from LayFit import *
import clr
clr.AddReference('ProtoGeometry')
from Autodesk.DesignScript.Geometry import *
	
# The inputs to this node will be stored as a list in the IN variables.
ROOFDECK=IN[0]
UPPERDECK=IN[1]
LOWERDECK=IN[2]

PERLOW=solstoCurvesFS(MACROTOSOL(LOWERDECK),0)
PERUPP=solstoCurvesFS(MACROTOSOL(UPPERDECK),12) 
PERROO=solstoCurvesFS(MACROTOSOL(ROOFDECK),24)

LEV2WALLS=[]
LLEV2W=[]
for a in PERROO:
	LowerLine=a.Translate(Vector.ByCoordinates(0,0,-12))
	UpperLine=a.Translate(Vector.ByCoordinates(0,0,2))
	LINES=[LowerLine,UpperLine]
	SUR1=Surface.ByLoft(LINES)
	WALL=SUR1.Thicken(0.25)
	LEV2WALLS.append(WALL)
	LLEV2W.append(LowerLine)

LEV1WALLS=[]
LLEV1W=[]
for a in PERLOW:
	LowerLine=a.Translate(Vector.ByCoordinates(0,0,0))
	UpperLine=a.Translate(Vector.ByCoordinates(0,0,12))
	for a in LEV2WALLS:
		if not a.DoesIntersect(UpperLine):
			UpperLine.Translate(Vector.ByCoordinates(0,0,2))
	LINES=[LowerLine,UpperLine]
	SUR1=Surface.ByLoft(LINES)
	WALL=SUR1.Thicken(0.25)
	LEV1WALLS.append(WALL)
	LLEV1W.append(LowerLine)

POLYLOW=PolyCurve.ByJoinedCurves(PERLOW)
POLYUPP=PolyCurve.ByJoinedCurves(PERUPP)
POLYROO=PolyCurve.ByJoinedCurves(PERROO)

POLYCURVES=[POLYLOW,POLYUPP,POLYROO]	

ALLCURVES=[]
for a in PERLOW:
	ALLCURVES.append(a)
for a in PERROO:
	ALLCURVES.append(a.Translate(Vector.ByCoordinates(0,0,-12)))

# Moduled Families
WALLMOD=MODULESFROMLINES(ALLCURVES,4)

# Assign your output to the OUT variable. 
OUT = POLYCURVES,LEV2WALLS,LEV1WALLS,LLEV1W,LLEV2W,WALLMOD[0],WALLMOD[1],WALLMOD[2]
# ----------------------------------------
code_block_6 = CodeBlock(a=create_of_floors_and_walls) { a; }

# group: Floor Creation
code_block_7 = CodeBlock(a=code_block_6) { a[0]; }
floor_types = FloorTypes("Generic 150mm")
levels = Levels("Level 1")
byOutlineTypeAndLevel = Floor.ByOutlineTypeAndLevel(outline=code_block_7, floorType=floor_types, level=levels)

# group: Wall Creation
code_block_8 = CodeBlock(a=code_block_6) { a[3]; }
python_script_2 = Python(IN[0]=code_block_8)
# ---------- python_script_2.python (16 lines) ----------
# Load the Python Standard and DesignScript Libraries
import sys
import clr
clr.AddReference('ProtoGeometry')
from Autodesk.DesignScript.Geometry import *

# The inputs to this node will be stored as a list in the IN variables.
Curves= IN[0]
NC=[]
for a in Curves:
	NC.append(a.Reverse())	

# Place your code below this line

# Assign your output to the OUT variable.
OUT = NC
# ----------------------------------------
code_block_9 = CodeBlock { 12; }
levels_2 = Levels("Level 1")
wall_types = WallTypes("Generic - 200mm")
byCurveAndHeight = Wall.ByCurveAndHeight(curve=python_script_2, height=code_block_9, level=levels_2, wallType=wall_types)
code_block_10 = CodeBlock(a=code_block_6) { a[4]; }
code_block_11 = CodeBlock { 14; }
levels_3 = Levels("Level 2")
byCurveAndHeight_2 = Wall.ByCurveAndHeight(curve=code_block_10, height=code_block_11, level=levels_3, wallType=wall_types)

family_types = FamilyTypes("CIRCULANT:CIRCULANT")
all_elements_of_family_type = ElementsOfFamilyType(Family_Type=family_types)
geometry = Element.Geometry(element=all_elements_of_family_type)
firstItem = List.FirstItem(list=geometry@L2)
off_circulations = Python(IN[0]=LOWERMODS, IN[1]=firstItem)
# ---------- off_circulations.python (70 lines) ----------
# Load the Python Standard and DesignScript Libraries
import sys,os
from os import path
dumps_dir = path.expandvars(r'%ProgramW6432%\Dynamo\RA\BIMRA')
sys.path.append(dumps_dir)
from ModClass import *
from RAForms import *
from LayFit import *
import clr
clr.AddReference('ProtoGeometry')
from Autodesk.DesignScript.Geometry import *

MODULES = IN[0]
CIRLINES=shortline(IN[1])
XVEC=Vector.ByCoordinates(1,0,0)
YVEC=Vector.ByCoordinates(0,1,0)
MICROS=[]
#CREATING THE MICROUNIVERSE
for a in MODULES:
	if not (a.NAM == "VOID" or a.NAM== "BALCONY" or a.NAM == "TERRACE") : 
		LXGRID=MACTOGRIDS(a)[0]
		LYGRID=MACTOGRIDS(a)[1]
		CREATEMICROS(LXGRID,LYGRID,a,XVEC,YVEC,MICROS)
#CREATING THE INDEXDATABASE
indices=[]
for a in MICROS:
	indices.append(str(a.MIOF)+"_"+str(a.IOF)) 
 
SELIND=[]
CIRC=[]
#NLCI=extendLine(CIRLINES,2.5) 
for a in MICROS:
	for b in CIRLINES:
		LINN=b.Translate(Vector.ByCoordinates(0,0,0))
		CIL=Cylinder.ByPointsRadius(LINN.StartPoint,LINN.EndPoint,0.5)
		if CIL.DoesIntersect(a.SOL):
			SELIND.append(str(a.MIOF)+"_"+str(a.IOF))	
			CIRC.append(a.SOL)	
#	SELIND.append("JALO")
SELIND=list(set(SELIND))

for a in SELIND:
	indices.remove(a)
	
REMANENT=[]	
for a in MICROS:
	if (str(a.MIOF)+"_"+str(a.IOF)) in indices:	
		REMANENT.append(a)
	
REMAINF=[]
MODULENAME=[]
for a in MODULES:
	if not (a.NAM == "VOID" or a.NAM== "BALCONY" or a.NAM == "TERRACE") :
		REMAIN=[]
		for b in REMANENT:
			if b.SOL.DoesIntersect(Cuboid.ByLengths(a.CSYS,a.WID-2,a.LEN-2,a.HEI)):
				REMAIN.append(b.SOL)
		REMAINF.append(REMAIN)
		MODULENAME.append(a.NAM)
SELIND=list(set(SELIND))	

GEOMS=[]
INDICES=[]
for a in MICROS:
	if (str(a.MIOF)+"_"+str(a.IOF)) in indices:	
		GEOMS.append(a.SOL)
		INDICES.append(str(a.MIOF)+"_"+str(a.IOF))

# Assign your output to the OUT variable.
OUT = MICROS,GEOMS,indices,CIRC,SELIND,REMAINF,CIRLINES,LXGRID,LYGRID,MODULENAME
# ----------------------------------------
code_block_12 = CodeBlock(a=off_circulations) { a[5]; }
code_block_13 = CodeBlock(a=create_of_floors_and_walls) { a[2]; }
code_block_14 = CodeBlock(a=off_circulations) { a[9]; }
lower_walls = Python(IN[0]=code_block_12, IN[1]=code_block_13, IN[2]=code_block_14)
# ---------- lower_walls.python (104 lines) ----------
# Load the Python Standard and DesignScript Libraries
import sys,os
from os import path
dumps_dir = path.expandvars(r'%LOCALAPPDATA%\Programs\RA\BIMRA')
sys.path.append(dumps_dir)
from ModClass import *
from RAForms import *
from LayFit import *
import clr
clr.AddReference('ProtoGeometry')
from Autodesk.DesignScript.Geometry import *

# The inputs to this node will be stored as a list in the IN variables.
SS = IN[0]
WALLS=IN[1]
NAMES=IN[2]
BS=[]
for a,b in zip(SS,NAMES):
	if b!="KITCHEN" and b!="LIVING" and b!="DINNER":
		SOL=Solid.ByUnion(a)
		P1=Plane.ByOriginNormal(Point.ByCoordinates(0,0,0),Vector.ByCoordinates(0,0,1))
		SUR=SOL.Intersect(P1)[0]
		BS.append(SUR)  
##SET 
ALLVER=[]
for a in BS:
	VR=a.Vertices
	for b in VR:
		ALLVER.append(b.PointGeometry)
SETS=[]		
for a in BS:
	PC=a.Edges
	LNS=[]
	for b in PC:
		PTS=[]
		for c in ALLVER:
			if c.DoesIntersect(b.CurveGeometry):
				PTS.append(c)
		if len(PTS)>0:
			LA=b.CurveGeometry.SplitByPoints(PTS)
			for d in LA:
				LNS.append(d)
		else:
			LNS.append(b.CurveGeometry)
	SETS.append(LNS)
		
		

ALLNW=[]
for a in SETS:
#	ALLNW.append(PC)
	INDEXWALLS=[]
	for b in range(len(a)):
		for c in WALLS:
			if shortlines(a[b]).DoesIntersect(c):
				INDEXWALLS.append(b)
	for c,d in zip(a,range(len(a))):
		if not d in INDEXWALLS:
			ALLNW.append(c)
LENLIN=[]
x=0.001
for a,b in zip(ALLNW,range(len(ALLNW))):
	LENLIN.append(float(round(a.Length,3))+x)
	x+=0.001
LENLIN2=list(LENLIN)	
LENLIN2.sort()
LENLIN2.reverse()
NWSET=[]
for a in LENLIN2:
	NWSET.append(ALLNW[LENLIN.index(a)])

RESLINES=[]
NO=[]
for a,b in zip(NWSET,range(len(NWSET))):
	INCLA=[]
	if b not in NO:
		for c,d in zip(NWSET,range(len(NWSET))):
			if not b==d:
				if shortlines(a).DoesIntersect(shortlines(c)):
					NO.append(d)
		RESLINES.append(a)	

# Place your code below this line
ML=[]
MA=[]
LEN=[]
for a in RESLINES:
	if a.Length<4:
		ML.append(TOLs(a).PointAtParameter(0.5))
		MA.append(TOLs(a).Direction)
		LEN.append(a.Length)
	else:
		DIVLEN=a.Length/4
		POIS=[]
		for b in range(int(DIVLEN)+1):
			POIS.append(a.PointAtSegmentLength(b*4))
		LINESS=a.SplitByPoints(POIS)
		for c in LINESS:
			if c.Length>1:
				ML.append(TOLs(c).PointAtParameter(0.5))
				MA.append(TOLs(c).Direction)
				LEN.append(round(c.Length))		
# Assign your output to the OUT variable.
OUT = ML,MA,LEN,RESLINES
# ----------------------------------------
code_block_15 = CodeBlock(a=lower_walls) { a[3]; }
off_circulations_2 = Python(IN[0]=UPPERMODS, IN[1]=firstItem)
# ---------- off_circulations_2.python (70 lines) ----------
# Load the Python Standard and DesignScript Libraries
import sys,os
from os import path
dumps_dir = path.expandvars(r'%ProgramW6432%\Dynamo\RA\BIMRA')
sys.path.append(dumps_dir)
from ModClass import *
from RAForms import *
from LayFit import *
import clr
clr.AddReference('ProtoGeometry')
from Autodesk.DesignScript.Geometry import *

MODULES = IN[0]
CIRLINES=shortline(IN[1])
XVEC=Vector.ByCoordinates(1,0,0)
YVEC=Vector.ByCoordinates(0,1,0)
MICROS=[]
#CREATING THE MICROUNIVERSE
for a in MODULES:
	if not (a.NAM == "VOID" or a.NAM== "BALCONY" or a.NAM == "TERRACE") : 
		LXGRID=MACTOGRIDS(a)[0]
		LYGRID=MACTOGRIDS(a)[1]
		CREATEMICROS(LXGRID,LYGRID,a,XVEC,YVEC,MICROS)
#CREATING THE INDEXDATABASE
indices=[]
for a in MICROS:
	indices.append(str(a.MIOF)+"_"+str(a.IOF)) 
 
SELIND=[]
CIRC=[]
#NLCI=extendLine(CIRLINES,2.5) 
for a in MICROS:
	for b in CIRLINES:
		LINN=b.Translate(Vector.ByCoordinates(0,0,-1))
		CIL=Cylinder.ByPointsRadius(LINN.StartPoint,LINN.EndPoint,0.5)
		if CIL.DoesIntersect(a.SOL):
			SELIND.append(str(a.MIOF)+"_"+str(a.IOF))	
			CIRC.append(a.SOL)	
#	SELIND.append("JALO")
SELIND=list(set(SELIND))

for a in SELIND:
	indices.remove(a)
	
REMANENT=[]	
for a in MICROS:
	if (str(a.MIOF)+"_"+str(a.IOF)) in indices:	
		REMANENT.append(a)
	
REMAINF=[]
MODULENAME=[]
for a in MODULES:
	if not (a.NAM == "VOID" or a.NAM== "BALCONY" or a.NAM == "TERRACE") :
		REMAIN=[]
		for b in REMANENT:
			if b.SOL.DoesIntersect(Cuboid.ByLengths(a.CSYS,a.WID-2,a.LEN-2,a.HEI)):
				REMAIN.append(b.SOL)
		REMAINF.append(REMAIN)
		MODULENAME.append(a.NAM)
SELIND=list(set(SELIND))	

GEOMS=[]
INDICES=[]
for a in MICROS:
	if (str(a.MIOF)+"_"+str(a.IOF)) in indices:	
		GEOMS.append(a.SOL)
		INDICES.append(str(a.MIOF)+"_"+str(a.IOF))

# Assign your output to the OUT variable.
OUT = MICROS,GEOMS,indices,CIRC,SELIND,REMAINF,CIRLINES,LXGRID,LYGRID,MODULENAME
# ----------------------------------------
code_block_16 = CodeBlock(a=off_circulations_2) { a[5]; }
code_block_17 = CodeBlock(a=create_of_floors_and_walls) { a[1]; }
upper_walls = Python(IN[0]=code_block_16, IN[1]=code_block_17)
# ---------- upper_walls.python (99 lines) ----------
# Load the Python Standard and DesignScript Libraries
import sys,os
from os import path
dumps_dir = path.expandvars(r'%ProgramW6432%\Dynamo\RA\BIMRA')
sys.path.append(dumps_dir)
from ModClass import *
from RAForms import *
from LayFit import *
import clr
clr.AddReference('ProtoGeometry')
from Autodesk.DesignScript.Geometry import *

# The inputs to this node will be stored as a list in the IN variables.
SS = IN[0]
WALLS=IN[1]
BS=[]
for a in SS:
	SOL=Solid.ByUnion(a)
	P1=Plane.ByOriginNormal(Point.ByCoordinates(0,0,12),Vector.ByCoordinates(0,0,1))
	SUR=SOL.Intersect(P1)[0]
	BS.append(SUR)
ALLVER=[]
for a in BS:
	VR=a.Vertices
	for b in VR:
		ALLVER.append(b.PointGeometry)	
SETS=[]		
for a in BS:
	PC=a.Edges
	LNS=[]
	for b in PC:
		PTS=[]
		for c in ALLVER:
			if c.DoesIntersect(b.CurveGeometry):
				PTS.append(c)
		if len(PTS)>0:
			LA=b.CurveGeometry.SplitByPoints(PTS)
			for d in LA:
				LNS.append(d)
		else:
			LNS.append(b.CurveGeometry)
	SETS.append(LNS)
		
ALLNW=[]
for a in SETS:
#	ALLNW.append(PC)
	INDEXWALLS=[]
	for b in range(len(a)):
		for c in WALLS:
			if shortlines(a[b]).DoesIntersect(c):
				INDEXWALLS.append(b)
	for c,d in zip(a,range(len(a))):
		if not d in INDEXWALLS:
			ALLNW.append(c)
LENLIN=[]
x=0.001
for a,b in zip(ALLNW,range(len(ALLNW))):
	LENLIN.append(float(round(a.Length,3))+x)
	x+=0.001
LENLIN2=list(LENLIN)	
LENLIN2.sort()
LENLIN2.reverse()
NWSET=[]
for a in LENLIN2:
	NWSET.append(ALLNW[LENLIN.index(a)])

RESLINES=[]
NO=[]
for a,b in zip(NWSET,range(len(NWSET))):
	INCLA=[]
	if b not in NO:
		for c,d in zip(NWSET,range(len(NWSET))):
			if not b==d:
				if shortlines(a).DoesIntersect(shortlines(c)):
					NO.append(d)
		RESLINES.append(a)	
		
ML=[]
MA=[]
LEN=[]
for a in RESLINES:
	if a.Length<4:
		ML.append(TOLs(a).PointAtParameter(0.5))
		MA.append(TOLs(a).Direction)
		LEN.append(a.Length)
	else:
		DIVLEN=a.Length/4
		POIS=[]
		for b in range(int(DIVLEN)+1):
			POIS.append(a.PointAtSegmentLength(b*4))
		LINESS=a.SplitByPoints(POIS)
		for c in LINESS:
			if c.Length>1:
				ML.append(TOLs(c).PointAtParameter(0.5))
				MA.append(TOLs(c).Direction)
				LEN.append(round(c.Length))	
	
# Assign your output to the OUT variable.
OUT = ML,MA,LEN,RESLINES
# ----------------------------------------
code_block_18 = CodeBlock(a=upper_walls) { a[3]; }

# group: Wall Creation
code_block_19 = CodeBlock { 11; }
levels_4 = Levels("Level 1")
wall_types_2 = WallTypes("Interior - 135mm Partition (2-hr)")
byCurveAndHeight_3 = Wall.ByCurveAndHeight(curve=code_block_15, height=code_block_19, level=levels_4, wallType=wall_types_2)
code_block_20 = CodeBlock { 11; }
levels_5 = Levels("Level 2")
byCurveAndHeight_4 = Wall.ByCurveAndHeight(curve=code_block_18, height=code_block_20, level=levels_5, wallType=wall_types_2)

code_block_21 = CodeBlock(a=off_circulations_2) { a[9]; }
code_block_22 = CodeBlock(a=off_circulations_2) { a[3]; }
create_layouts_01 = Python(IN[0]=code_block_16, IN[1]=code_block_21, IN[2]=code_block_17, IN[3]=code_block_22)
# ---------- create_layouts_01.python (72 lines) ----------
# Load the Python Standard and DesignScript Libraries
import sys,os
from os import path
dumps_dir = path.expandvars(r'%ProgramW6432%\Dynamo\RA\BIMRA')
sys.path.append(dumps_dir)
from ModClass import *
from RAForms import *
from LayFit import *
import clr
import System.Collections.Generic
from System.Collections.Generic import List
from System.Collections.Generic import Dictionary
import math
clr.AddReference('ProtoGeometry')
from Autodesk.DesignScript.Geometry import *

# The inputs to this node will be stored as a list in the IN variables.
MODULES = IN[0]
NAMES = IN[1]
WALLS = IN[2]
CORRIDOR = IN[3]
MOD=2

SOLIDSS=[]
for a in MODULES:
	SOLIDSS.append(Solid.ByUnion(a))
CORRID=Solid.ByUnion(CORRIDOR) 

SURFS=[]
for a in SOLIDSS:
	P1=Plane.ByOriginNormal(Point.ByCoordinates(0,0,12),Vector.ByCoordinates(0,0,1))
	SUR=a.Intersect(P1)[0]
	SURFS.append(SUR)
        
CURSS=[]    
for a in SURFS:
	CUR=a.Edges
	CURS=[]
	for a in CUR:
		CURS.append(TOL(a.CurveGeometry))
	CURSS.append(CURS)
	
SURFS=[]
for a in CURSS:
	POL=PolyCurve.ByJoinedCurves(a)
	SURFS.append(Surface.ByPatch(POL))  
 
CABSS=[]
ORDSS=[]
for a,b in zip(SURFS,CURSS):
	REC=createmodulesfromsurf(a,MOD) 
	ORDC=b
	ORDSS.append(ORDC)
	WALLS=LinestoWalls(b)
	CLRECS=flattenlst3(REC)
	LV=LINESANDVECS(ORDC,CLRECS)
	LV2=SPV(ORDC,LV[0],LV[1])
	CABS=[]
	M=0
	for a,b in zip(LV2[0],LV2[1]):
		modulate(a,b,2,1,2,0,0.5,1,M,CABS)
		M=M+(len(a))
	CABSS.append(CABS)     
	   
   
 
		 
  
 
 
# Assign your output to the OUT variable.
OUT = CABSS,ORDSS,CORRID,NAMES
# ----------------------------------------
code_block_23 = CodeBlock(a=create_layouts_01) { a[0]; }
python_script_3 = Python(IN[0]=code_block_23)
# ---------- python_script_3.python (18 lines) ----------
# Load the Python Standard and DesignScript Libraries
import sys
import clr
clr.AddReference('ProtoGeometry')
from Autodesk.DesignScript.Geometry import *

# The inputs to this node will be stored as a list in the IN variables.
fur = IN[0]
# Place your code below this line
val1=[]

for a in fur:
	TASK=[]
	for b in a:
		TASK.append(b.SOL)
	val1.append(TASK)
# Assign your output to the OUT variable.
OUT = val1
# ----------------------------------------
code_block_24 = CodeBlock(a=off_circulations) { a[3]; }
create_layouts_02 = Python(IN[0]=code_block_12, IN[1]=code_block_14, IN[2]=code_block_13, IN[3]=code_block_24)
# ---------- create_layouts_02.python (75 lines) ----------
# Load the Python Standard and DesignScript Libraries
import sys,os
from os import path
dumps_dir = path.expandvars(r'%ProgramW6432%\Dynamo\RA\BIMRA')
sys.path.append(dumps_dir)
from ModClass import *
from RAForms import *
from LayFit import *
import clr
import System.Collections.Generic
from System.Collections.Generic import List
from System.Collections.Generic import Dictionary
import math
clr.AddReference('ProtoGeometry')
from Autodesk.DesignScript.Geometry import *

# The inputs to this node will be stored as a list in the IN variables.
MODULES = IN[0]
NAMES = IN[1]
WALLS = IN[2]
CORRIDOR = IN[3]
MOD=2

SOLIDSS=[]
for a in MODULES:
	try:
		SOLIDSS.append(Solid.ByUnion(a))
	except:
		pass
CORRID=Solid.ByUnion(CORRIDOR)

SURFS=[]
for a in SOLIDSS:
	P1=Plane.ByOriginNormal(Point.ByCoordinates(0,0,0),Vector.ByCoordinates(0,0,1))
	SUR=a.Intersect(P1)[0]
	SURFS.append(SUR)
        
CURSS=[]    
for a in SURFS:
	CUR=a.Edges
	CURS=[]
	for a in CUR:
		CURS.append(TOL(a.CurveGeometry))
	CURSS.append(CURS)
	
SURFS=[]
for a in CURSS:
	POL=PolyCurve.ByJoinedCurves(a)
	SURFS.append(Surface.ByPatch(POL))  
 
CABSS=[]
ORDSS=[]
for a,b in zip(SURFS,CURSS):
	REC=createmodulesfromsurf(a,MOD) 
	ORDC=b
	ORDSS.append(ORDC)
	WALLS=LinestoWalls(b)
	CLRECS=flattenlst3(REC)
	LV=LINESANDVECS(ORDC,CLRECS)
	LV2=SPV(ORDC,LV[0],LV[1])
	CABS=[]
	M=0
	for a,b in zip(LV2[0],LV2[1]):
		modulate(a,b,2,1,2,0,0.5,1,M,CABS)
		M=M+(len(a))
	CABSS.append(CABS)     
	   
   
 
		 
  
 
 
# Assign your output to the OUT variable.
OUT = CABSS,ORDSS,CORRID,NAMES
# ----------------------------------------
code_block_25 = CodeBlock(a=create_layouts_02) { a[0]; }
python_script_4 = Python(IN[0]=code_block_25)  # same code as python_script_3
code_block_26 = CodeBlock { "DW_SET"; }
byName = Family.ByName(name=code_block_26)
code_block_27 = CodeBlock(a=create_layouts_01) { a[3]; }
all_furnits = Python(IN[0]=code_block_23, IN[1]=code_block_17, IN[2]=code_block_22, IN[3]=code_block_27)
# ---------- all_furnits.python (30 lines) ----------
# Load the Python Standard and DesignScript Libraries
import sys,os
from os import path
dumps_dir = path.expandvars(r'%ProgramW6432%\Dynamo\RA\BIMRA')
sys.path.append(dumps_dir)
from ModClass import *
from RAForms import *
from LayFit import *
import clr
import math
clr.AddReference('ProtoGeometry')
from Autodesk.DesignScript.Geometry import *

MODULES=IN[0]
SOLWIN=IN[1] 
SOLDOR=IN[2]
NAMES=IN[3]
RESULTS=[]
#for a in MODULES:
for a,b in zip(MODULES,NAMES):
	RESULTS.append(LAYINGOUTC(a,SOLWIN,SOLDOR,b))
  
PDOORS=[]
PWINS=[]

for a in RESULTS:
	PDOORS.append(a[3])
	PWINS.append(a[4])

OUT = PDOORS,PWINS
# ----------------------------------------
code_block_28 = CodeBlock(a=all_furnits) { a[1]; }
flatten = List.Flatten(list=code_block_28)
python_script_5 = Python(IN[0]=flatten)
# ---------- python_script_5.python (18 lines) ----------
# Load the Python Standard and DesignScript Libraries
import sys
import clr
clr.AddReference('ProtoGeometry')
from Autodesk.DesignScript.Geometry import *

# The inputs to this node will be stored as a list in the IN variables.
fur = IN[0]
# Place your code below this line
ORI=[]
NAM=[]
TYPE=[]
for a in fur:
	ORI.append(a.ORI)
	NAM.append("Single Window")
	TYPE.append(a.VEC)
# Assign your output to the OUT variable.
OUT = ORI,NAM,TYPE
# ----------------------------------------
code_block_29 = CodeBlock(a=python_script_5) { a[1]; }
byFamilyAndName = FamilyType.ByFamilyAndName(family=byName, name=code_block_29)
code_block_30 = CodeBlock(a=python_script_5) { a[0]; }
byPoint = FamilyInstance.ByPoint(familyType=byFamilyAndName, point=code_block_30)
code_block_31 = CodeBlock(a=python_script_5) { a[2]; }
python_script_6 = Python(IN[0]=code_block_31)
# ---------- python_script_6.python (20 lines) ----------
# Load the Python Standard and DesignScript Libraries
import sys,os
from os import path
dumps_dir = path.expandvars(r'%LOCALAPPDATA%\Programs\RA\BIMRA')
sys.path.append(dumps_dir)
from ModClass import *
from RAForms import *
from LayFit import *
import clr
clr.AddReference('ProtoGeometry')
from Autodesk.DesignScript.Geometry import *

# The inputs to this node will be stored as a list in the IN variables.
VECL = IN[0]

VECS=[]
for a in VECL:
	VECS.append(getangleofvector(a))
# Assign your output to the OUT variable.
OUT = VECS
# ----------------------------------------
code_block_32 = CodeBlock(familyinstance1=byPoint, t1=python_script_6) { familyinstance2 = FamilyInstance.SetRotation(familyinstance1, t1); }
code_block_33 = CodeBlock(a=all_furnits) { a[0]; }
flatten_2 = List.Flatten(list=code_block_33)
python_script_7 = Python(IN[0]=flatten_2)
# ---------- python_script_7.python (18 lines) ----------
# Load the Python Standard and DesignScript Libraries
import sys
import clr
clr.AddReference('ProtoGeometry')
from Autodesk.DesignScript.Geometry import *

# The inputs to this node will be stored as a list in the IN variables.
fur = IN[0]
# Place your code below this line
ORI=[]
NAM=[]
TYPE=[]
for a in fur:
	ORI.append(a.ORI)
	NAM.append("Single Door")
	TYPE.append(a.VEC)
# Assign your output to the OUT variable.
OUT = ORI,NAM,TYPE 
# ----------------------------------------
code_block_34 = CodeBlock(a=python_script_7) { a[1]; }
byFamilyAndName_2 = FamilyType.ByFamilyAndName(family=byName, name=code_block_34)
code_block_35 = CodeBlock(a=python_script_7) { a[0]; }
byPoint_2 = FamilyInstance.ByPoint(familyType=byFamilyAndName_2, point=code_block_35)
code_block_36 = CodeBlock(a=python_script_7) { a[2]; }
python_script_8 = Python(IN[0]=code_block_36)
# ---------- python_script_8.python (20 lines) ----------
# Load the Python Standard and DesignScript Libraries
import sys,os
from os import path
dumps_dir = path.expandvars(r'%ProgramW6432%\Dynamo\RA\BIMRA')
sys.path.append(dumps_dir)
from ModClass import *
from RAForms import *
from LayFit import *
import clr
clr.AddReference('ProtoGeometry')
from Autodesk.DesignScript.Geometry import *

# The inputs to this node will be stored as a list in the IN variables.
VECL = IN[0]

VECS=[]
for a in VECL:
	VECS.append(getangleofvector(a))
# Assign your output to the OUT variable.
OUT = VECS
# ----------------------------------------
code_block_37 = CodeBlock(familyinstance1=byPoint_2, t1=python_script_8) { familyinstance2 = FamilyInstance.SetRotation(familyinstance1, t1); }
code_block_38 = CodeBlock { "DW_SET"; }
byName_2 = Family.ByName(name=code_block_38)
code_block_39 = CodeBlock(a=create_layouts_02) { a[3]; }
all_furnits_2 = Python(IN[0]=code_block_25, IN[1]=code_block_13, IN[2]=code_block_22, IN[3]=code_block_39)
# ---------- all_furnits_2.python (32 lines) ----------
# Load the Python Standard and DesignScript Libraries
import sys,os
from os import path
dumps_dir = path.expandvars(r'%ProgramW6432%\Dynamo\RA\BIMRA')
sys.path.append(dumps_dir)
from ModClass import *
from RAForms import *
from LayFit import *
import clr
import math
clr.AddReference('ProtoGeometry')
from Autodesk.DesignScript.Geometry import *

MODULES=IN[0]
SOLWIN=IN[1]
SOLDOR=IN[2]
NAMES=IN[3]
RESULTS=[]
#for a in MODULES:
for a,b in zip(MODULES,NAMES):
	RESULTS.append(LAYINGOUTC(a,SOLWIN,SOLDOR,b))
         
PDOORS=[]
PWINS=[]
PIDOORS=[]
PIWINDS=[]

for a in RESULTS:
	PDOORS.append(a[3])
	PWINS.append(a[4])

OUT = PDOORS,PWINS
# ----------------------------------------
code_block_40 = CodeBlock(a=all_furnits_2) { a[1]; }
flatten_3 = List.Flatten(list=code_block_40)
python_script_9 = Python(IN[0]=flatten_3)  # same code as python_script_5
code_block_41 = CodeBlock(a=python_script_9) { a[1]; }
byFamilyAndName_3 = FamilyType.ByFamilyAndName(family=byName_2, name=code_block_41)
code_block_42 = CodeBlock(a=python_script_9) { a[0]; }
byPoint_3 = FamilyInstance.ByPoint(familyType=byFamilyAndName_3, point=code_block_42)
code_block_43 = CodeBlock(a=python_script_9) { a[2]; }
python_script_10 = Python(IN[0]=code_block_43)  # same code as python_script_6
code_block_44 = CodeBlock(familyinstance1=byPoint_3, t1=python_script_10) { familyinstance2 = FamilyInstance.SetRotation(familyinstance1, t1); }
code_block_45 = CodeBlock(a=all_furnits_2) { a[0]; }
flatten_4 = List.Flatten(list=code_block_45)
python_script_11 = Python(IN[0]=flatten_4)  # same code as python_script_7
code_block_46 = CodeBlock(a=python_script_11) { a[1]; }
byFamilyAndName_4 = FamilyType.ByFamilyAndName(family=byName_2, name=code_block_46)
code_block_47 = CodeBlock(a=python_script_11) { a[0]; }
byPoint_4 = FamilyInstance.ByPoint(familyType=byFamilyAndName_4, point=code_block_47)
code_block_48 = CodeBlock(a=python_script_11) { a[2]; }
python_script_12 = Python(IN[0]=code_block_48)  # same code as python_script_8
code_block_49 = CodeBlock(familyinstance1=byPoint_4, t1=python_script_12) { familyinstance2 = FamilyInstance.SetRotation(familyinstance1, t1); }
