# Dynamo graph 07_Place Furniture.dyn (Dynamo 2.6.1.8786)

categories = Categories("OST_SpecialityEquipment")
all_elements_of_category = ElementsOfCategory(Category=categories)
code_block = CodeBlock { "Type"; }
getParameterValueByName = Element.GetParameterValueByName(element=all_elements_of_category, parameterName=code_block)
code_block_2 = CodeBlock { "Name"; }
getParameterValueByName_2 = Element.GetParameterValueByName(element=getParameterValueByName, parameterName=code_block_2)
getLocation = Element.GetLocation(element=all_elements_of_category)
code_block_3 = CodeBlock { "TWidth"; }
getParameterValueByName_3 = Element.GetParameterValueByName(element=all_elements_of_category, parameterName=code_block_3)
code_block_4 = CodeBlock { "TLength"; }
getParameterValueByName_4 = Element.GetParameterValueByName(element=all_elements_of_category, parameterName=code_block_4)
code_block_5 = CodeBlock { "THeigth"; }
getParameterValueByName_5 = Element.GetParameterValueByName(element=all_elements_of_category, parameterName=code_block_5)
python_script = Python(IN[0]=getParameterValueByName_2, IN[1]=getLocation, IN[2]=getParameterValueByName_3, IN[3]=getParameterValueByName_4, IN[4]=getParameterValueByName_5)
# ---------- python_script.python (28 lines) ----------
# Load the Python Standard and DesignScript Libraries
import sys,os
from os import path
dumps_dir = path.expandvars(r'%ProgramW6432%\Dynamo\RA\BIMRA')
sys.path.append(dumps_dir)
from ModClass import *
from RAForms import *
from LayFit import *
import clr
clr.AddReference('ProtoGeometry')
from Autodesk.DesignScript.Geometry import *

# The inputs to this node will be stored as a list in the IN variables.
Name=IN[0]
Point=IN[1]
Width=IN[2]
Length=IN[3] 
Heigth=IN[4]
MACROS=[]

for a,b,c,d,e,f in zip(Name,Point,Length,Width,Heigth,range(len(Name))):
	MACROS.append(selfmacro(a,b,c,d,e,f))
	 
SOLS=[]	
for a in MACROS:
	SOLS.append(a.SOL)
# Assign your output to the OUT variable.
OUT = MACROS
# ----------------------------------------
family_types = FamilyTypes("CIRCULANT:CIRCULANT")
all_elements_of_family_type = ElementsOfFamilyType(Family_Type=family_types)
geometry = Element.Geometry(element=all_elements_of_family_type)
firstItem = List.FirstItem(list=geometry@L2)
MODULES = Python(IN[0]=python_script, IN[1]=firstItem)
# ---------- MODULES.python (76 lines) ----------
# Load the Python Standard and DesignScript Libraries
import sys,os
from os import path
dumps_dir = path.expandvars(r'%LOCALAPPDATA%\Programs\RA\BIMRA')
sys.path.append(dumps_dir)
from ModClass import *
from RAForms import *
from LayFit import *
import clr
clr.AddReference('ProtoGeometry')
from Autodesk.DesignScript.Geometry import *
import System.Collections.Generic
from System.Collections.Generic import List
from System.Collections.Generic import Dictionary

MODULES = IN[0]
CIRLINES=shortline(IN[1])
XVEC=Vector.ByCoordinates(1,0,0)
YVEC=Vector.ByCoordinates(0,1,0)
MICROS=[]
ORIS=[]
#CREATING THE MICROUNIVERSE
for a in MODULES:
	if not (a.NAM == "VOID" or a.NAM== "BALCONY" or a.NAM == "TERRACE") : 
		LXGRID=MACTOGRIDS(a)[0]
		LYGRID=MACTOGRIDS(a)[1]
		CREATEMICROS(LXGRID,LYGRID,a,XVEC,YVEC,MICROS)
		ORIS.append(a.ORI)
 		
#CREATING THE INDEXDATABASE
indices=[]
for a in MICROS:
	indices.append(str(a.MIOF)+"_"+str(a.IOF))

SELIND=[]
CIRC=[]

for a in MICROS:
	for b in CIRLINES:
		POI=b.Translate(Vector.ByCoordinates(0,0,-1))
		if Cylinder.ByPointsRadius(POI.StartPoint,POI.EndPoint,1).DoesIntersect(a.SOL):
			SELIND.append(str(a.MIOF)+"_"+str(a.IOF))	
			CIRC.append(a.SOL)	


SELIND=list(set(SELIND))
for a in SELIND:
	indices.remove(a)
	
REMANENT=[]	
for a in MICROS:
	if (str(a.MIOF)+"_"+str(a.IOF)) in indices:	
		REMANENT.append(a)
	
REMAINF=[]
MODULENAME=[]
for a in MODULES:
	if not (a.NAM == "VOID" or a.NAM== "BALCONY" or a.NAM == "TERRACE") :
		REMAIN=[]
		for b in REMANENT:
			if b.SOL.DoesIntersect(Cuboid.ByLengths(a.CSYS,a.WID-2,a.LEN-2,a.HEI)):
				REMAIN.append(b.SOL)
		REMAINF.append(REMAIN)
		MODULENAME.append(a.NAM)
#	SELIND.append("JALO")
SELIND=list(set(SELIND))	

GEOMS=[]
INDICES=[]
for a in MICROS:
	if (str(a.MIOF)+"_"+str(a.IOF)) in indices:	
		GEOMS.append(a.SOL)
		INDICES.append(str(a.MIOF)+"_"+str(a.IOF))
		
# Assign your output to the OUT variable.
OUT = MICROS,GEOMS,indices,CIRC,SELIND,REMAINF,CIRLINES,LXGRID,LYGRID,MODULENAME,ORIS
# ----------------------------------------
code_block_6 = CodeBlock(a=MODULES) { a[5]; }
code_block_7 = CodeBlock(a=MODULES) { a[9]; }
categories_2 = Categories("OST_Walls")
all_elements_of_category_2 = ElementsOfCategory(Category=categories_2)
getLocation_2 = Element.GetLocation(element=all_elements_of_category_2)
code_block_8 = CodeBlock(a=MODULES) { a[3]; }
code_block_9 = CodeBlock(a=MODULES) { a[10]; }
code_block_10 = CodeBlock { "DW_SET"; }
byName = Family.ByName(name=code_block_10)
types = Family.Types(family=byName)
all_elements_of_family_type_2 = ElementsOfFamilyType(Family_Type=types)
getLocation_3 = Element.GetLocation(element=all_elements_of_family_type_2)
geometry_2 = Element.Geometry(element=all_elements_of_family_type_2)
code_block_11 = CodeBlock { 1; }
flatten = List.Flatten(list=geometry_2@L3, amt=code_block_11)
create_layouts_01 = Python(IN[0]=code_block_6, IN[1]=code_block_7, IN[2]=getLocation_2, IN[3]=code_block_8, IN[4]=code_block_9, IN[5]=getLocation_3, IN[6]=flatten)
# ---------- create_layouts_01.python (108 lines) ----------
# Load the Python Standard and DesignScript Libraries
import sys,os
from os import path
dumps_dir = path.expandvars(r'%ProgramW6432%\Dynamo\RA\BIMRA')
sys.path.append(dumps_dir)
from ModClass import *
from RAForms import *
from LayFit import *
import clr
import System.Collections.Generic
from System.Collections.Generic import List
from System.Collections.Generic import Dictionary
import math
clr.AddReference('ProtoGeometry')
from Autodesk.DesignScript.Geometry import *

# The inputs to this node will be stored as a list in the IN variables.
MODULES = IN[0]
NAMES = IN[1]
WALLS = IN[2]
CORRIDOR = IN[3]
MOD=2
ORIS=IN[4]
DWORI=IN[5]
DWSOL=IN[6]

SOLIDSS=[]
for a in MODULES:
	SOLIDSS.append(Solid.ByUnion(a))
CORRID=Solid.ByUnion(CORRIDOR) 

SURFS=[]
for a,b in zip(SOLIDSS,ORIS):
	if b.Z<5:
		P1=Plane.ByOriginNormal(Point.ByCoordinates(0,0,0),Vector.ByCoordinates(0,0,1))
		SUR=a.Intersect(P1)[0]
	else:
		P2=Plane.ByOriginNormal(Point.ByCoordinates(0,0,12),Vector.ByCoordinates(0,0,1))
		SUR=a.Intersect(P2)[0]
	SURFS.append(SUR)

TORIDOORS=[]
TSOLDOORS=[]
for a in SURFS:
	TTORIDOORS=[]
	TTSOLDOORS=[]
	for b,c in zip(DWORI[0],DWSOL[0]):
		if c.DoesIntersect(a):
			TTORIDOORS.append(b)
			TTSOLDOORS.append(c)
	TORIDOORS.append(TTORIDOORS)
	TSOLDOORS.append(TTSOLDOORS)

TORIWIN=[]
TSOLWIN=[]
for a in SURFS:
	TTORIWIN=[]
	TTSOLWIN=[]
	for b,c in zip(DWORI[1],DWSOL[1]):
		if c.DoesIntersect(a):
			TTORIWIN.append(b)
			TTSOLWIN.append(c)
	TORIWIN.append(TTORIWIN)
	TSOLWIN.append(TTSOLWIN)


TTDORWIN=[]
for a,b,c,d in zip(TORIDOORS,TSOLDOORS,TORIWIN,TSOLWIN):
	TTDORWIN.append([a,b,c,d])

CURSS=[]    
for a in SURFS:
	CUR=a.Edges
	CURS=[]
	for a in CUR:
		CURS.append(TOL(a.CurveGeometry))
	CURSS.append(CURS)
	
SURFS=[]
for a in CURSS:
	POL=PolyCurve.ByJoinedCurves(a)
	SURFS.append(Surface.ByPatch(POL))  
 
CABSS=[]
ORDSS=[]
for a,b in zip(SURFS,CURSS):
	REC=createmodulesfromsurf(a,MOD) 
	ORDC=b
	ORDSS.append(ORDC)
	WALLS=LinestoWalls(b)
	CLRECS=flattenlst3(REC)
	LV=LINESANDVECS(ORDC,CLRECS)
	LV2=SPV(ORDC,LV[0],LV[1])
	CABS=[]
	M=0
	for a,b in zip(LV2[0],LV2[1]):
		modulate(a,b,2,1,2,0,0.5,1,M,CABS)
		M=M+(len(a))
	CABSS.append(CABS)     
   
   
 
		 
  
 
 
# Assign your output to the OUT variable.
OUT = CABSS,ORDSS,CORRID,NAMES,SURFS,TTDORWIN
# ----------------------------------------
code_block_12 = CodeBlock(a=create_layouts_01) { a[0]; }
python_script_2 = Python(IN[0]=code_block_12)
# ---------- python_script_2.python (18 lines) ----------
# Load the Python Standard and DesignScript Libraries
import sys
import clr
clr.AddReference('ProtoGeometry')
from Autodesk.DesignScript.Geometry import *

# The inputs to this node will be stored as a list in the IN variables.
fur = IN[0]
# Place your code below this line
val1=[]

for a in fur:
	TASK=[]
	for b in a:
		TASK.append(b.SOL)
	val1.append(TASK)
# Assign your output to the OUT variable.
OUT = val1
# ----------------------------------------
code_block_13 = CodeBlock(a=create_layouts_01) { a[3]; }
code_block_14 = CodeBlock(a=create_layouts_01) { a[5]; }
all_furnits = Python(IN[0]=code_block_12, IN[1]=code_block_13, IN[2]=code_block_14)
# ---------- all_furnits.python (29 lines) ----------
# Load the Python Standard and DesignScript Libraries
import sys,os
from os import path
dumps_dir = path.expandvars(r'%ProgramW6432%\Dynamo\RA\BIMRA')
sys.path.append(dumps_dir)
from ModClass import *
from RAForms import *
from LayFit import *
import clr
import math
clr.AddReference('ProtoGeometry')
from Autodesk.DesignScript.Geometry import *

MODULES=IN[0]
NAMES=IN[1]
DW=IN[2]
 

RESULTS=[]
#for a in MODULES:
for a,b,c in zip(MODULES,NAMES,DW):
	RESULTS.append(LAYINGOUTD(a,b,c))  
  
#FURNITE=[]
#for a in RESULTS:
#	FURNITE.append(a.SOL)
 

OUT = RESULTS
# ----------------------------------------
flatten_2 = List.Flatten(list=all_furnits)
python_script_3 = Python(IN[0]=flatten_2, IN[1]=getLocation_2, IN[2]=all_elements_of_category_2)
# ---------- python_script_3.python (27 lines) ----------
# Load the Python Standard and DesignScript Libraries
import sys
import clr
clr.AddReference('ProtoGeometry')
from Autodesk.DesignScript.Geometry import *

# The inputs to this node will be stored as a list in the IN variables.
FURS=IN[0]
WALLLINE=IN[1]
WALL=IN[2]

WALLFUR=[]
LOC=[]
VEC=[]
FAM=[] 
NAM=[]
for a in FURS:
	for b,c in zip(WALLLINE,WALL):
		if b.DoesIntersect(Sphere.ByCenterPointRadius(a.ORI,1)):
			WALLFUR.append(c)
	LOC.append(a.ORI) 
	VEC.append(a.VEC)
	FAM.append(a.FAMNAM) 
	NAM.append(a.TYPE)	 

# Assign your output to the OUT variable.
OUT = WALLFUR,LOC,VEC,FAM,NAM
# ----------------------------------------
code_block_15 = CodeBlock(a=python_script_3) { a[3]; }
byName_2 = Family.ByName(name=code_block_15)
code_block_16 = CodeBlock(a=python_script_3) { a[4]; }
byFamilyAndName = FamilyType.ByFamilyAndName(family=byName_2, name=code_block_16)
code_block_17 = CodeBlock(a=python_script_3) { a[1]; }
code_block_18 = CodeBlock(a=python_script_3) { a[2]; }
code_block_19 = CodeBlock(a=python_script_3) { a[0]; }
code_block_20 = CodeBlock { "Type"; }
getParameterValueByName_6 = Element.GetParameterValueByName(element=code_block_19, parameterName=code_block_20)
code_block_21 = CodeBlock { "Width"; }
getParameterValueByName_7 = Element.GetParameterValueByName(element=getParameterValueByName_6, parameterName=code_block_21)
code_block_22 = CodeBlock(a=getParameterValueByName_7) { Math.Round(a,2)/2; }
translate = Geometry.Translate(geometry=code_block_17, direction=code_block_18, distance=code_block_22)
byPoint = FamilyInstance.ByPoint(familyType=byFamilyAndName, point=translate)
python_script_4 = Python(IN[0]=code_block_18)
# ---------- python_script_4.python (20 lines) ----------
# Load the Python Standard and DesignScript Libraries
import sys,os
from os import path
dumps_dir = path.expandvars(r'%ProgramW6432%\Dynamo\RA\BIMRA')
sys.path.append(dumps_dir)
from ModClass import *
from RAForms import *
from LayFit import *
import clr
clr.AddReference('ProtoGeometry')
from Autodesk.DesignScript.Geometry import *

# The inputs to this node will be stored as a list in the IN variables.
VECL = IN[0]

VECS=[]
for a in VECL:
	VECS.append(getangleofvector(a))
# Assign your output to the OUT variable.
OUT = VECS
# ----------------------------------------
setRotation = FamilyInstance.SetRotation(familyInstance=byPoint, degree=python_script_4)
